# Grasshopper definition 06 Brick Wall Assembly.gh (Grasshopper 1.0.7)

# ----
# Brick dimensions are fixed!
number_slider = Slider(0.045, range=0..1)
number_slider_2 = Slider(0.09, range=0..1)
number_slider_3 = Slider(0.025, range=0..1)

list = ValueList({"no_tool": 0, "measurement_tool": 1, "brick_gripper": 2}, selected="brick_gripper")
list_2 = ValueList({"UR3", "UR5", "UR10", "UR10e"}, selected="UR3")
block_def = GhPythonScript(width=number_slider_2, length=number_slider, height=number_slider_3)  # -> out, block
# ---------- block_def: Python ----------
import os
import sys
import json

from compas.geometry import Frame
from compas.geometry import Vector
from compas.geometry import Box
from ur_online_control.ur.configuration import Configuration

from assembly_information_model.assembly import Element


#definition: units in meter
#width = 0.02
#length = 0.23
#height = 0.005

#width = 0.08
#length = 0.05
#height = 0.04

#tolerance_vector = Vector(0, 0, 0.001)
#savelevel_vector = Vector(0, 0, 0.05)

#picking_frame = Frame([-0.43, 0, height], [1, 0, 0], [0, 1, 0])
#picking_configuration = Configuration.from_revolute_values([-6.027, 4.443, -2.313, 5.724, 1.571, -2.885])

# block
box_frame = Frame([length/2, width/2, height/2], [1, 0, 0], [0, 1, 0]) #center of the box frame 
box = Box(box_frame, length, width, height) 
tool_frame = Frame([length/2, width/2, height], [1, 0, 0], [0, -1, 0])
block = Element.from_shape(box, tool_frame)
block.id = "short"
# ---------- end block_def ----------
list_3 = ValueList({"20", "50", "100", "500", "1000", "5000"}, selected="500")
reset = Button()
back = Button()
start = Button()
step = Button()
stop = Button()

# ----
# density of bricks
number_slider_4 = Slider(7, range=0..100)

# ----
# Input surface
surface = Surface(<surface referenced from the Rhino model>)

division = Division(A=number_slider_3, B=2)
division_2 = Division(A=number_slider, B=2)
# 3) Set up bricks
division_3 = Division(A=number_slider_2, B=-4)
pt = ConstructPoint(XCoordinate=division_3, YCoordinate=division_2, ZCoordinate=0)
tools = Tools(tool_id=list)

# ---- group: Robot_1
# 2) Set up robot
y_axis = Curve(<curve referenced from the Rhino model>)
x_axis = Curve(<curve referenced from the Rhino model>)
plane = PythonScript(plane_axes=[x_axis, y_axis])  # -> plane; inputs plane_axes: list of Curve
# ---------- plane: Python ----------
import Rhino.Geometry as rg

#Sets up the planes used by the robot (y and x axis passed in)
x_axis, y_axis = plane_axes

x_axis = rg.Line(x_axis.PointAtStart, x_axis.PointAtEnd)
y_axis = rg.Line(y_axis.PointAtStart, y_axis.PointAtEnd)

if x_axis.From.DistanceTo(y_axis.From) < 0.01:
    origin = x_axis.From
    xvec = x_axis.Direction
    yvec = y_axis.Direction
elif x_axis.To.DistanceTo(y_axis.To) < 0.01:
    origin = x_axis.To
    xvec = -x_axis.Direction
    yvec = -y_axis.Direction
elif x_axis.From.DistanceTo(y_axis.To) < 0.01:
    origin = x_axis.From
    xvec = x_axis.Direction
    yvec = -y_axis.Direction
elif x_axis.To.DistanceTo(y_axis.From) < 0.01:
    origin = x_axis.To
    xvec = -x_axis.Direction
    yvec = y_axis.Direction

plane = rg.Plane(origin, xvec, yvec)
# ---------- end plane ----------
base = PythonScript(base_plane=plane)  # -> base_frame, base_plane
# ---------- base: Python ----------
from compas.geometry import Frame
from compas.geometry import Transformation, Rotation
from compas_ghpython import draw_frame
import math
import Rhino.Geometry as rg

# sets up a Frame which plane pasted in

bp = base_plane
base_frame = Frame(bp.Origin, bp.XAxis, bp.YAxis)
# ---------- end base ----------
robot = PythonScript(model=list_2)  # -> robot
# ---------- robot: Python ----------
from ur_online_control.ur.ur10e import UR10e
from ur_online_control.ur.ur10 import UR10
from ur_online_control.ur.ur5 import UR5
from ur_online_control.ur.ur3 import UR3
from scriptcontext import sticky as st

# sets up the correct model using the following imported scripts
if model == "UR3":
    robot = UR3()
if model == "UR5":
    robot = UR5()
if model == "UR10":
    robot = UR10()
if model == "UR10e":
    robot = UR10e()
# ---------- end robot ----------
set_params = PythonScript(robot=robot, tool=tools, base_frame=base.base_frame)  # -> robot
# ---------- set_params: Python ----------
from ur_online_control.ur.ur10e import UR10e
from scriptcontext import sticky as st
from ur_online_control.ur.tool import Tool
from compas.geometry import Frame

# assigns the robot the specfic tool and base frame
if tool:
    robot.set_tool(tool)
else:
    robot.set_tool(Tool(Frame.worldXY()))  
if base_frame:
    robot.set_base(base_frame)

# creates a global var for the robot
st["robot"] = robot
# ---------- end set_params ----------

# ----
# This point marks the
# lowest point of your wall
pt_2 = Point(Point(0.5864803875, 0.08135650391, 0.02877203975))

# ----
# 1) Set up connection
button = Button()

server_ip = ValueList({"192.168.10.44", "192.168.10.12", "192.168.10.11", "192.168.10.10", "192.168.10.3", "192.168.10.2", "192.168.10.1", "127.0.0.1", "192.168.10.111"}, selected="192.168.10.1")
server_port = ValueList({"50002", "50003", "50004", "50005"}, selected="50002")
ur_ip = ValueList({"192.168.10.10", "192.168.10.20", "192.168.10.11", "192.168.10.12", "127.0.0.1", "192.168.10.111"}, selected="192.168.10.10")
ur_port = ValueList({"30002"}, selected="30002")
globals = PythonScript(server_address=server_ip, server_port=server_port, ur_ip=ur_ip, ur_port=ur_port, clear=button)  # inputs server_port: Int32
# ---------- globals: Python ----------
from scriptcontext import sticky as st

#set up the variables used to set up the robot
st["server_address"] = server_address
st["server_port"] = server_port
st["ur_ip"] = ur_ip
st["ur_port"] = ur_port

#clear the variables
if clear:
    st.clear()
# ---------- end globals ----------

ping = Button()
py = PythonScript(ip=ur_ip, ping=ping)  # -> out, trigger
# ---------- py: Python ----------
from scriptcontext import sticky as st
from ur_online_control.ur_direct import is_available

guid = str(ghenv.Component.InstanceGuid)
txt_key = "txt_" + guid


if txt_key not in st:
    st[txt_key] = ""
    

#if the ping button is hit run the following code
if ping:

#runs a script that checks to see if you are able to connect to the robot
#records the result and print it
    available = is_available(ip)
    
    if available:
        st[txt_key] = "%s is up!" % ip
        trigger = True
    else:
        st[txt_key] = "%s is down!" % ip
        trigger = False
print(st[txt_key])
# ---------- end py ----------
panel = Panel(py.out)

# ---- group: Visualise
start_2 = Button()
stop_2 = Button()
step_2 = Button()
back_2 = Button()
reset_2 = Button()
full = Button()
list_4 = ValueList({"20", "50", "100", "500", "1000", "5000"}, selected="20")

# ----
# Play with brick position /
# orientation etc. here
unit_z = UnitZ(Factor=1)
domain_box = DomainBox(Base=pt, X=number_slider_2, Y=number_slider, Z=number_slider_3)
deconstruct_brep = DeconstructBrep(Brep=domain_box)  # -> Faces, Edges, Vertices
contour = Contour(Shape=surface, Point=pt_2, Direction=unit_z, Distance=number_slider_3)  # -> flatten(Contours)
list_item = ListItem(List=deconstruct_brep.Faces, Index=Slider(5, range=0..5), Wrap=True)
dispatch = Dispatch(List=contour, DispatchPattern=[True, False])  # -> ListA, ListB
area = Area(Geometry=list_item)  # -> Area, Centroid
curve = Curve(dispatch.ListA)
curve_2 = Curve(dispatch.ListB)
item = ListItem(List=curve_2, Index=0, Wrap=True)
xy_plane = XYPlane(Origin=area.Centroid)
flip = FlipCurve(Curve=curve_2, Guide=item)  # -> Curve, Flag
horizontal_frames = HorizontalFrames(Curve=flip.Curve, Count=number_slider_4)  # -> Frames, Parameters
plane_2 = Plane(horizontal_frames.Frames)
dispatch_2 = Dispatch(List=plane_2, DispatchPattern=[True, False])  # -> ListA, ListB
unit_z_2 = UnitZ(Factor=number_slider_3)
plane_3 = Plane(dispatch_2.ListB)

item_2 = ListItem(List=curve, Index=0, Wrap=True)
flip_2 = FlipCurve(Curve=curve, Guide=item_2)  # -> Curve, Flag
pflip = FlipPlane(Plane=xy_plane, ReverseX=False, ReverseY=False, SwapAxes=True)
prot = RotatePlane(Plane=pflip, Angle=1.570796327)

# ----
# PickUpPose
pt_3 = Point(<point referenced from the Rhino model>)
pln = Plane(prot)

pl_origin = PlaneOrigin(Base=pln, Origin=pt_3)

# ----
# 4) Generates assembly code
# and object to be picked up
# Define an element and its dimensions inside cluster
cp = Plane(PlaneXY(0.6, 0.2, 0))

horizontal_frames_2 = HorizontalFrames(Curve=flip_2.Curve, Count=number_slider_4)  # -> Frames, Parameters
plane_4 = Plane(horizontal_frames_2.Frames)
dispatch_3 = Dispatch(List=plane_4, DispatchPattern=[True, False])  # -> ListA, ListB
orient = Orient(Geometry=domain_box, Source=pflip, Target=pl_origin)  # -> flatten(Geometry), Transform
plane_5 = Plane(dispatch_3.ListA)
move = Move(Geometry=[plane_5, plane_3], Motion=unit_z_2)  # -> Geometry, Transform

# ----
# pick-up
# visualisation
box = Box(orient.Geometry)

pflip_2 = FlipPlane(Plane=move.Geometry, ReverseX=False, ReverseY=False, SwapAxes=True)

# ----
# Final planes that define
#    brick orientation and
#       robot movement!
pln_2 = Plane(flatten(pflip_2))

# ----
# Creates the assembly coded to be passed to the robot
generate_assembly = GhPythonScript(centerplane=cp, pickUpObject=block_def.block, brickPlanes=pln_2, pickUpPlane=pln)  # -> out, assembly; inputs brickPlanes: list of Plane, pickUpPlane: Plane
# ---------- generate_assembly: Python ----------
import Rhino.Geometry as rg
import math
from scriptcontext import sticky as st


from compas.geometry import Frame
from compas.geometry import Transformation
from compas.geometry import Rotation
from compas.geometry import Translation
from compas.geometry import Point

from compas_ghpython.geometry import xtransformed
from compas_ghpython import draw_frame

from assembly_information_model.assembly import Assembly
from assembly_information_model.assembly import Element

import Rhino.Geometry as rg

# initialize an empty assembly class
assembly = Assembly()

planes = [] # just for vizualisation

cp = centerplane
cf = Frame(cp.Origin, cp.XAxis, cp.YAxis)

# calculated the frame from the points on the curve
for p in brickPlanes:
    f = Frame((p.Origin), p.XAxis, p.YAxis)
    print p.XAxis
    
#    T = Transformation.from_frame_to_frame(Frame.worldXY(), f)
    T = Transformation.from_frame_to_frame(Frame(pickUpPlane.Origin, pickUpPlane.XAxis, pickUpPlane.YAxis), f)
    print pickUpObject
    new_block = pickUpObject.transformed(T)
    assembly.add_element(new_block, robot=1)
    
#for key, element, data in assembly.elements(data=True):
#    print key, element, data

'''


#for i in range(1): # loop through the number of layers i
#    
#    axis = cf.zaxis
#    angle = math.radians(i*3)
#    
#    R = Rotation.from_axis_and_angle(axis, angle, point=cp.Origin) #Calculates a ``Rotation`` from a rotation axis and an angle and an optional point of rotation.
#    T = Translation([0,0,0.005*i])
#    
#    cft = cf.transformed(R * T) #transforms the origin plane
#    
#    if i%2 == 0: 
#        R = Rotation.from_axis_and_angle(cft.zaxis, math.radians(90), point=cft.point)
#        cft = cft.transformed(R)
#       
#    add = math.sin(i/5)*0.015
#    
#    o1 = cft.point + cft.yaxis*(0.075+add)
#    o2 = cft.point - cft.yaxis*(0.075+add)
#    
#    f1 = Frame(o1, cft.xaxis, cft.yaxis)
#    f2 = Frame(o2, cft.xaxis, cft.yaxis)
#    
#    planes.append(draw_frame(f1))
#    planes.append(draw_frame(f2))
#    
#    T1 = Transformation.from_frame_to_frame(Frame.worldXY(), f1)
#    T2 = Transformation.from_frame_to_frame(Frame.worldXY(), f2)
#    
#    # create new instances of the element
#    new_block_1 = pickUpObject.transformed(T1) #returns a deep copy of the initial element at the new location of the frame
#    new_block_2 = pickUpObject.transformed(T2)
#
#    assembly.add_element(new_block_1, robot=1)
#    assembly.add_element(new_block_2, robot=1)
    

    for key, element, data in assembly.elements(data=True):
        print key, element, data
'''
# ---------- end generate_assembly ----------
path_mapping = GhPythonScript(assembly=generate_assembly.assembly, pick_up_plane_WCS=pl_origin)  # -> out, trajectories, assembly; inputs pick_up_plane_WCS: Plane
# ---------- path_mapping: Python ----------
from scriptcontext import sticky as st
from compas.geometry import Frame, Translation
from compas_ghpython import draw_frame

import Rhino.Geometry as rg


""" Procedure 
00. Safe plane above pickup plane
10. Pickup plane
20. Safe plane above pickup plane
30. Safe plane above release plane
40. Release plane
50. Safe plane above pickup plane
"""

trajectories = []
pup = pick_up_plane_WCS
pickup_frame = Frame(pup.Origin, pup.XAxis, pup.YAxis)
# number at which the robot can safely drop the object
safe_level_placement = 0.05
safe_level_pickup = 0.2
# height of the stack
stack_num = 10
y_loc = 0
# calculates the element paths needed to pick up object from the starting pt
# and to drop off the object along the curve
for key, element, data in assembly.elements(data=True):
    width = element._source.ysize
    length = element._source.xsize
    height = element._source.zsize
    
    '''
    # Linear array (stacks) of pickup frame locations in negative world z direction and positive world y direction
    full_stack_height = stack_num*height
    current_stack_height = full_stack_height - (key%stack_num)*height
    if key%stack_num == 0:
        y_loc += width
    T = Translation([0, y_loc, current_stack_height])
    '''
    
    element_pickup = pickup_frame #.transformed(T)
    
    _10frame = element_pickup
    _40frame = element.tool_frame
    
    _00frame = _10frame.transformed(Translation(_10frame.zaxis*-safe_level_pickup))
    _20frame = _00frame
    
    _30frame = _40frame.transformed(Translation(_40frame.zaxis*-safe_level_placement))
    _50frame = _30frame
    
    element.path = [_00frame, _10frame, _20frame, _30frame, _40frame, _50frame]
    trajectories.extend([draw_frame(frame) for frame in element.path])
# ---------- end path_mapping ----------
pln_3 = Plane(path_mapping.trajectories)

# ---- group: Visualise
# Chooses a counter based on the buttons
# Chooses a point on the curve to move to (after picking up object) using the counter
# 5) Picks the point on the curve
# for robot to drop object at
obj_position = CountThroughList(
    assembly=path_mapping.assembly,
    start=start_2,
    stop=stop_2,
    step=step_2,
    step_back=back_2,
    reset=reset_2,
    full=full,
    interval=list_4)  # -> item, counter; inputs start: Boolean, stop: Boolean, step_back: Boolean
# ---------- obj_position: Python ----------
from scriptcontext import sticky as st
from compas_ghpython import update_component

# gets max number of movements for the robot by looking at the amount of elements
# are in the assembly
L = list(assembly.elements())

# create variable name for the counter and the boolean that is either true if
# the counter is running or false if not

guid = str(ghenv.Component.InstanceGuid)
counter_key = "counter_" + guid
running_key = "running_" + guid


# depending on which button is clicked changes the counter or running boolean
# accordingly 
if counter_key not in st:
    st[counter_key] = 0

if running_key not in st:
    st[running_key] = False

if start:
    st[running_key] = True

if stop:
    st[running_key] = False

if step:
    if st[counter_key] < len(L) - 1:
        st[counter_key] += 1

if step_back:
    if st[counter_key] < len(L) - 1:
        st[counter_key] -= 1

if reset:
    st[counter_key] = 0

if len(L):
    item = L[st[counter_key]]

if st[running_key]:
    if st[counter_key] < len(L) - 1:
        st[counter_key] += 1
        update_component(ghenv, interval)
    else:
        st[counter_key] = 0
        st[running_key] = False

counter = st[counter_key]
# ---------- end obj_position ----------
idx = Panel(obj_position.counter)
getspecificpathplanes = PythonScript(assembly=path_mapping.assembly, counter=idx)  # -> out, current_path_planes; inputs counter: Int32
# ---------- getspecificpathplanes: Python ----------
import os
import sys

import math

from compas_ghpython.artists import MeshArtist
from compas_ghpython import draw_frame

# gets the paths planes 
current_path_planes = [draw_frame(plane) for plane in assembly.element(counter).path]
# ---------- end getspecificpathplanes ----------
show = BooleanToggle(True)
show_2 = BooleanToggle(True)
draw = PythonScript(assembly=path_mapping.assembly, show_all=show, show_counter=show_2, counter=idx)  # -> out, G; inputs counter: Int32
# ---------- draw: Python ----------
import os
import sys

import math

from compas_ghpython.artists import MeshArtist
from compas_ghpython import draw_frame

#from assembly_information_model.artist import AssemblyArtist


G = []

key_index = assembly.network.key_index()
keys = [key_index[key] for key in assembly.network.nodes()]
# gets the object that will be placed along the curve
elements = [assembly.element(key) for key in keys] 

# calculates the tool and the path planes for the robot in order to drop off
# the object accordingly
tool_planes_WCS = [draw_frame(e.tool_frame) for e in elements]
path_planes_WCS = [draw_frame(t_plane) for element in elements for t_plane in element.path]

current_tool_plane = tool_planes_WCS[counter]
current_path_planes = [draw_frame(plane) for plane in assembly.element(counter).path]

# draws all the objects after placement
if show_all and not show_counter:
    for element in elements:
        artist = MeshArtist(element.mesh)
        mesh = artist.draw_mesh()
        G.append(mesh)
# draws the specfic placement
if show_counter:
    for element in elements[0:counter+1]:
        artist = MeshArtist(element.mesh)
        mesh = artist.draw_mesh()
        G.append(mesh)
# ---------- end draw ----------
# Draws brick at specific location on the curve
mesh = Mesh(draw.G)

# ----
# 6) Draw the robot movement
# Selects the specfic configuration to be drawn
# Calculates the configurations of the joints for the robot to first pick up the object then put it on the point on the curve
idx_2 = Slider(2, range=0..7)
inverse_multiple = PythonScript(robot=set_params, planes_WCS=getspecificpathplanes.current_path_planes, configuration_idx=idx_2)  # -> configurations; inputs planes_WCS: list, configuration_idx: Int32, init_configuration: list
# ---------- inverse_multiple: Python ----------
from compas_ghpython import unload_modules
unload_modules('ur_online_control')

import Rhino.Geometry as rg
from compas.geometry import Frame 
from compas.geometry import Transformation
from compas_ghpython import draw_frame
from ur_online_control.ur.kinematics import calculate_configurations_for_path, format_joint_positions


# TODO this must be optimized! matrix multiplication!

# creates frames from the inputted planes
frames_tool0_RCS = []
for plane_WCS in planes_WCS:
    tcp_WCS = Frame(plane_WCS.Origin, plane_WCS.XAxis, plane_WCS.YAxis)
    tcp_RCS = robot.get_frame_in_RCS(tcp_WCS)
    frames_tool0_RCS.append(robot.get_tool0_frame_from_tcp_frame(tcp_RCS))
 
# coverts those frames into configurations for the robot arm
# as we are not giving specifc joint values multiple configurations are created
configurations = calculate_configurations_for_path(frames_tool0_RCS, robot, init_configuration)

# here the configuration is selected  of the joints due to the index passed in
configurations = configurations[min([configuration_idx, len(configurations) - 1])]
# ---------- end inverse_multiple ----------
counter = CountThroughList(L=inverse_multiple, start=start, stop=stop, step=step, step_back=back, reset=reset, interval=list_3)  # -> item, counter; inputs L: list, start: Boolean, stop: Boolean, step_back: Boolean
# ---------- counter: Python ----------
from scriptcontext import sticky as st
from compas_ghpython import update_component


# create variable name for the counter and the boolean that is either true if
# the counter is running or false if not

guid = str(ghenv.Component.InstanceGuid)
counter_key = "counter_" + guid
running_key = "running_" + guid


# depending on which button is clicked changes the counter or running boolean
# accordingly 
if counter_key not in st:
    st[counter_key] = 0

if running_key not in st:
    st[running_key] = False

if start:
    st[running_key] = True

if stop:
    st[running_key] = False

if step:
    if st[counter_key] < len(L) - 1:
        st[counter_key] += 1

if step_back:
    if st[counter_key] < len(L) - 1:
        st[counter_key] -= 1

if reset:
    st[counter_key] = 0

if len(L):
    item = L[st[counter_key]]

if st[running_key]:
    if st[counter_key] < len(L) - 1:
        st[counter_key] += 1
        update_component(ghenv, interval)
    else:
        st[counter_key] = 0
        st[running_key] = False

counter = st[counter_key]
# ---------- end counter ----------

# ----
# Same as 03 Movement on a curve
robots = Robots(model=list_2)  # -> robot_mesh_2, robot_brep_2
draw_2 = PythonScript(robot=set_params, configuration=counter.item, meshes=robots.robot_mesh_2, breps=robots.robot_brep_2)  # -> out, robot_mesh, tool_mesh; inputs meshes: list of Mesh, breps: list of Brep
# ---------- draw_2: Python ----------
from scriptcontext import sticky as st
from compas_ghpython import draw_frame


if configuration:
    #sets the meshes and breps of the robot
    if len(robot.model) == 0:
        print "hello"
        robot.model = meshes
        robot.model_breps = breps
    #draws the robot at it's new configuration
    tmodel = robot.xdraw(configuration)
    robot_mesh = tmodel[:6]
    tool_mesh = tmodel[6]
# ---------- end draw_2 ----------
robot_mesh = Mesh(draw_2.robot_mesh)
tool_mesh = Mesh(draw_2.tool_mesh)
preview = CustomPreview(Geometry=robot_mesh, Shader=ColourSwatch(SwatchColor=RGBA(99, 94, 94, 96)))
preview_2 = CustomPreview(Geometry=tool_mesh, Shader=ColourSwatch(SwatchColor=RGBA(204, 78, 78, 96)))

# ----
# This program is used to command the UR to pick up an object at a specfic location. The UR will then place that object at the defined planes.
orient_2 = Orient(Geometry=domain_box, Source=pflip, Target=pln_2)  # -> flatten(Geometry), Transform

plane_6 = Plane(getspecificpathplanes.current_path_planes)

exit_at_index = BooleanToggle(False)
stop_server = Button()
stop_robot = Button()
set_tasks = Button()
start_3 = Button()
init = Button()
fabricate = GhPythonScript(
    assembly=path_mapping.assembly,
    dfillet=Slider(0, range=0..100),
    speed=Slider(100, range=0..300),
    speed_mod=Slider(2, range=0..10),
    init=init,
    set_tasks=set_tasks,
    start=start_3,
    stop_robot=stop_robot,
    stop_server=stop_server,
    exit_at_index=exit_at_index,
    exit_index=Slider(1, range=0..10),
    index=idx)  # -> out, log, msgs, task, srv; inputs speed_mod: Int32, stop_robot: Boolean, exit_index: Int32, index: Int32
# ---------- fabricate: Python ----------
from scriptcontext import sticky as st
import ur_online_control.ur_direct as urd
from compas_ghpython import update_component
from ur_online_control.ur_direct import URCommandScript
from ur_online_control.communication.tcp_server import TCPFeedbackServer
from ur_online_control.fabrication_process import Fabrication

def get_robot(n):
    if n in [1,2]:
        ur_ip = st["ur_ip"]
        robot = st["robot"]
        return ur_ip, robot
        
def grippers(cmd):
    script_lines = []
    #closes the gripper
    if cmd == "close":
        script_lines.append("sleep(1)") 
        script_lines.append("set_digital_out(1, False)") 
        script_lines.append("set_digital_out(0, True)") 
        script_lines.append("sleep(1)")
    # opens the gripper
    if cmd == "open":
        script_lines.append("sleep(1)") 
        script_lines.append("set_digital_out(0, False)") 
        script_lines.append("set_digital_out(1, True)") 
        script_lines.append("sleep(1)") 
    return script_lines
        
def get_radius(i, frames, buffer = 0.7):
    if i == 1 or i == len(frames) - 3 or i == len(frames)-1:
        radius = 0.
    else:
        prev, current, next = frames[i-1].point, frames[i].point, frames[i+1].point
        radius = min((prev - current).length/2 * buffer, (next - current).length/2 * buffer, dfillet)
    return radius

def get_velocity(i, frames):
#    if i == len(frames) - 3 or i == 1:
#        speedval = speed/speed_mod
#    else:
#        speedval = speed
    speedval = speed/1000
    return speedval

def get_move_commands(frames, robot):
    movel_commands = []
    for i, frame_WCS in enumerate(frames):
        frame_RCS = robot.get_frame_in_RCS(frame_WCS)
        radius = get_radius(i, frames)
        velocity = get_velocity(i, frames)
        cmd = list(frame_RCS.point) + list(frame_RCS.axis_angle_vector) + [velocity, radius]
        movel_commands.append(cmd)
    return movel_commands

server_ip = st["server_address"]
server_port = st["server_port"]
ur_port = st["ur_port"]
ur_ip, robot = get_robot(1)

def get_ur_script(key, element, data):
    ur_ip, robot = get_robot(data['robot'])
    move_commands = get_move_commands(element.path, robot)
    tool_angle_axis = list(robot.tool.tcp_frame.point) + list(robot.tool.tcp_frame.axis_angle_vector)
    ur_script = URCommandScript(server_ip=server_ip, server_port=server_port, ur_ip=ur_ip, ur_port=ur_port)
    ur_script.start()
    #ur_script.add_airpick_commands()
    ur_script.set_tcp(tool_angle_axis)
    for i, move_command in enumerate(move_commands):
        if i == 2:
            ur_script.add_lines(grippers("close"))
        elif i == 5:
            ur_script.add_lines(grippers("open"))
        else:
            pass
        ur_script.add_move_linear(move_command, feedback="Full")
    ur_script.end(feedback=True)
    ur_script.generate()
    if exit_at_index:
        ur_script.exit_message = move_commands[exit_index][:6]
    return ur_script

def create_tasks():
#    for key, element, data in assembly.elements(data=True):
#        print data
    return [get_ur_script(key,element,data) for key, element, data in assembly.elements(data=True) if key >= index]


class Fabrication_UR(Fabrication):
    def perform_task(self, task):
        self.log("TASK START: ---->>>>>")
        task.generate()
        task.send_script()
        ok = self.server.listen(task.exit_message, 50)
        self.log(task.received_messages)
        if not ok:
            self.log("----<<<<< TASK FAILED")
            return False
        self.log("----<<<<< TASK FINISHED")
        return True

if init:
    fabrication = Fabrication_UR()
    server = TCPFeedbackServer(ip=server_ip, port=server_port)
    server.start()
    fabrication.server = server


if set_tasks:
    tasks = create_tasks()
#    print "tasks", tasks
    fabrication.clear_tasks()
    fabrication.set_tasks(tasks)
#    print fabrication.tasks[0]

if stop_server:
    print("closing server...")
    server.close()
    server.join()
    print("server joined")

if start:
    fabrication.start(server)

if stop_robot:
    urd.stop(ur_ip, ur_port)
    fabrication.is_paused

if send_single_task:
    rt = fabrication.perform_task(fabrication.tasks[index])
    print(rt)
    if rt:
        urd.stop(ur_ip, ur_port)

try:
    srv = server
    fab = fabrication
except NameError:
    srv = None
    fab = None
else:
    if len(fabrication.tasks) > 0:
        msgs = [str(task.exit_message) for task in fabrication.tasks]
        task = fabrication.tasks[0]
    log = fabrication.log_messages
# ---------- end fabricate ----------

# ----
# 7) Use fabrication to send over movements
# These buttons are used to send the signal over to the robot. Each is label with what it does (init is initialize).
# Python code that communicates with the robot depending on the button you pressed
# Any and all messages from the robot/code will be placed in these panels
# IF THERE IS AN ERROR COMMENT OUT LINES 53, 56-61
panel_2 = Panel(fabricate.srv)
panel_3 = Panel(fabricate.log)
panel_4 = Panel(fabricate.msgs)
panel_5 = Panel(fabricate.out)
panel_6 = Panel(fabricate.task)

# ==== cluster Robots
model = ClusterInput()
ur3_brep = Brep(reverse([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]))

# ---- group: robot geometry
py = PythonScript(model=model)  # -> n
# ---------- py: Python ----------
import time

if model == "UR3":
    n = 0

if model == "UR5":
    n = 1

if model == "UR10":
    n = 2

if model == "UR10e":
    n = 3

print n
# ---------- end py ----------
ur10e_brep = UR10Brep([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])
ur10_brep = UR10Brep([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])
ur5_brep = UR5Brep([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])
filter = StreamFilter(Gate=py, Stream0=ur3_brep, Stream1=ur5_brep, Stream2=ur10_brep, Stream3=ur10e_brep)

# ----
robot_mesh = Mesh(filter)
robot_brep = Brep(filter)
robot_mesh_2 = ClusterOutput(robot_mesh)
robot_brep_2 = ClusterOutput(robot_brep)

# ==== cluster Tools

# ---- group: Brick Gripper_v2
geometry = Geometry([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])
mesh = Mesh(geometry)
brep = Brep(geometry)
mjoin = MeshJoin(Meshes=mesh)
yaxis_line = Curve(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)
xaxis_line = Curve(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)
tool = PythonScript(meshes=mjoin, breps=brep, xline=xaxis_line, yline=yaxis_line)  # -> tool; inputs meshes: list of Mesh, breps: list of Brep
# ---------- tool: Python ----------
import Rhino.Geometry as rg
from compas.geometry import Frame
from ur_online_control.ur.tool import Tool

xaxis = rg.Line(xline.PointAtStart, xline.PointAtEnd)
yaxis = rg.Line(yline.PointAtStart, yline.PointAtEnd)

if xaxis.From.DistanceTo(yaxis.From) < 0.01:
    origin = xaxis.From
    xaxis = xaxis.Direction
    yaxis = yaxis.Direction
elif xaxis.To.DistanceTo(yaxis.To) < 0.01:
    origin = xaxis.To
    xaxis = -xaxis.Direction
    yaxis = -yaxis.Direction
elif xaxis.From.DistanceTo(yaxis.To) < 0.01:
    origin = xaxis.From
    xaxis = xaxis.Direction
    yaxis = -yaxis.Direction
elif xaxis.To.DistanceTo(yaxis.From) < 0.01:
    origin = xaxis.To
    xaxis = -xaxis.Direction
    yaxis = yaxis.Direction

xaxis.Unitize()
yaxis.Unitize()

print origin
print xaxis
print yaxis

tcp_frame = Frame(origin, xaxis, yaxis)

tool = Tool(tcp_frame)
tool.model = meshes
tool.model_breps = breps
# ---------- end tool ----------

# ---- group: measurement tool
geo = Geometry(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)
mesh_2 = Mesh(geo)
brep_2 = Brep(geo)
mjoin_2 = MeshJoin(Meshes=mesh_2)
xaxis_line_2 = Curve(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)
yaxis_line_2 = Curve(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)
tool_2 = PythonScript(meshes=mjoin_2, breps=brep_2, xline=xaxis_line_2, yline=yaxis_line_2)  # -> tool; inputs meshes: list of Mesh, breps: list of Brep; same code as tool

# ----
tool_id = ClusterInput()
tool_id_2 = Integer(tool_id)
filter = StreamFilter(Gate=tool_id_2, Stream1=tool_2, Stream2=tool)
py = PythonScript(tool=filter)  # -> tcp_frame, model
# ---------- py: Python ----------
from compas_ghpython import mesh_draw 

if tool:
    tcp_frame = tool.tcp_frame
    model = tool.model
# ---------- end py ----------
tool_3 = Data(filter)
draw = PythonScript(frame=py.tcp_frame)  # -> G, C
# ---------- draw: Python ----------
import Rhino.Geometry as rg
from System.Drawing import Color

if not size:
    size = 0.1

if frame:
    plane = rg.Plane(rg.Point3d(*list(frame.point)), rg.Vector3d(*list(frame.xaxis)), rg.Vector3d(*list(frame.yaxis)))

    G = []
    G.append(rg.Line(plane.Origin, size * plane.XAxis))
    G.append(rg.Line(plane.Origin, size * plane.YAxis))
    G.append(rg.Line(plane.Origin, size * plane.ZAxis))
    
    C = []
    C.append(Color.FromArgb(255, 0, 0))
    C.append(Color.FromArgb(0, 255, 0))
    C.append(Color.FromArgb(0, 0, 255))
# ---------- end draw ----------
tool_4 = ClusterOutput(tool_3)
preview = CustomPreview(Geometry=py.model, Shader=ColourSwatch(SwatchColor=RGBA(141, 170, 178, 150)))
preview_2 = CustomPreview(Geometry=draw.G, Shader=draw.C)
