# Grasshopper definition 01 Connecting.gh (Grasshopper 1.0.7)

# ----
# You are encouraged to edit things in the blue!
# (Also if you are comfortable
# try to play with the other things as well)
server_ip = ValueList({"192.168.10.44", "192.168.10.12", "192.168.10.11", "192.168.10.10", "192.168.10.3", "192.168.10.2", "192.168.10.1", "127.0.0.1", "192.168.10.111"}, selected="192.168.10.3")
server_port = ValueList({"50002", "50003", "50004", "50005"}, selected="50002")
ur_ip = ValueList({"192.168.10.10", "192.168.10.20", "192.168.10.11", "192.168.10.12", "127.0.0.1", "192.168.10.111"}, selected="192.168.10.11")
ur_port = ValueList({"30002"}, selected="30002")

# ----
# If you hit the button titled ping, the python component will run and attempt to connect to the robot. It will print out whether it was able to connect to the panel on the right.
# Check if UR robot
#  is available
ping = Button()
py = PythonScript(ip=ur_ip, ping=ping)  # -> out, trigger
# ---------- py: Python ----------
from scriptcontext import sticky as st
from ur_online_control.ur_direct import is_available

guid = str(ghenv.Component.InstanceGuid)
txt_key = "txt_" + guid


if txt_key not in st:
    st[txt_key] = ""
    

#if the ping button is hit run the following code
if ping:

#runs a script that checks to see if you are able to connect to the robot
#records the result and print it
    available = is_available(ip)
    
    if available:
        st[txt_key] = "%s is up!" % ip
        trigger = True
    else:
        st[txt_key] = "%s is down!" % ip
        trigger = False
print(st[txt_key])
# ---------- end py ----------
panel = Panel(py.out)

# ----
# Below are multiple value lists that contain the numbers needed to connect to the UR. They connect to a python node that sets these all up as global variables.
# --> Set your IP address
# --> Set robot IP address
globals = PythonScript(server_address=server_ip, server_port=server_port, ur_ip=ur_ip, ur_port=ur_port, clear=Button())  # inputs server_port: Int32
# ---------- globals: Python ----------
from scriptcontext import sticky as st

#set up the variables used to set up the robot
st["server_address"] = server_address
st["server_port"] = server_port
st["ur_ip"] = ur_ip
st["ur_port"] = ur_port

#clear the variables
if clear:
    st.clear()
# ---------- end globals ----------
