# Grasshopper definition 02 Simple joints.gh (Grasshopper 1.0.7)

# ----
# Set up connection
panel = Panel("Same as before")

# ----
# 2) Set the joint values
# Resets the sliders to a defualt value
# creates a robot joint configuration to be sent to the robot and to other grasshopper components that will visualize the robots
# WORRIED ABOUT A2 which way does it rotate
# These sliders set the values of rotation of each of the robots arms in degrees
# Make Sure the Robot won't hit anything before proceeding
a1 = Slider(-209, range=-360..360)
a2 = Slider(-180, range=-180..0)
a3 = Slider(83, range=-180..180)
a4 = Slider(214, range=-360..360)
a5 = Slider(0, range=-360..360)
a6 = Slider(0, range=-360..360)
reset = Button()
jp = GhPythonScript()  # -> joint_values
# ---------- jp: Python ----------
import math

#base joint values in degrees
joint_values = [0,0,0,0,0,0]
#converted to radians
joint_values = [math.radians(a) for a in joint_values]
print joint_values
# ---------- end jp ----------
forward_kinematics = PythonScript(set_joint_vals=reset, joint_values=jp, a1=a1, a2=a2, a3=a3, a4=a4, a5=a5, a6=a6)  # -> configuration; inputs joint_values: list
# ---------- forward_kinematics: Python ----------
import math
import Grasshopper
from ur_online_control.ur.configuration import Configuration

if set_joint_vals:
    j = 0
    #changes the input sliders to the original joint values
    for i in range(ghenv.Component.Params.Input.Count):
        nslider = ghenv.Component.Params.Input[i].Sources[0]
        if nslider.GetType() == Grasshopper.Kernel.Special.GH_NumberSlider:
            nslider.TrySetSliderValue(math.degrees(joint_values[j]))
            j += 1
#sets the join values to the ones given in the slider
joint_values = [a1, a2, a3, a4, a5, a6]
#creates a robot configuration from those values
configuration = Configuration.from_revolute_values([math.radians(d) for d in joint_values])

print configuration
# ---------- end forward_kinematics ----------

# ----
# You are encouraged to edit things in the blue!
# (Also if you are comfortable
# try to play with the other things as well)
list = ValueList({"no_tool": 0, "measurement_tool": 1, "air_pick 40mm": 2, "air_pick 15mm": 3, "electromagnet": 4}, selected="air_pick 40mm")
list_2 = ValueList({"UR5", "UR10", "UR10e"}, selected="UR5")

# ----
# --> Set your IP address
# --> Set robot IP address
server_ip = ValueList({"192.168.10.44", "192.168.10.12", "192.168.10.11", "192.168.10.10", "192.168.10.3", "192.168.10.2", "192.168.10.1", "127.0.0.1", "192.168.10.111"}, selected="192.168.10.2")
server_port = ValueList({"50002", "50003", "50004", "50005"}, selected="50002")
ur_ip = ValueList({"192.168.10.10", "192.168.10.20", "192.168.10.11", "192.168.10.12", "127.0.0.1", "192.168.10.111"}, selected="192.168.10.11")
ur_port = ValueList({"30002"}, selected="30002")
globals = PythonScript(server_address=server_ip, server_port=server_port, ur_ip=ur_ip, ur_port=ur_port, clear=Button())  # inputs server_port: Int32
# ---------- globals: Python ----------
from scriptcontext import sticky as st

#set up the variables used to set up the robot
st["server_address"] = server_address
st["server_port"] = server_port
st["ur_ip"] = ur_ip
st["ur_port"] = ur_port

#clear the variables
if clear:
    st.clear()
# ---------- end globals ----------

# ----
# Check if UR robot
#  is available
ping = Button()
py = PythonScript(ip=ur_ip, ping=ping)  # -> out, trigger
# ---------- py: Python ----------
from scriptcontext import sticky as st
from ur_online_control.ur_direct import is_available

guid = str(ghenv.Component.InstanceGuid)
txt_key = "txt_" + guid


if txt_key not in st:
    st[txt_key] = ""
    

#if the ping button is hit run the following code
if ping:

#runs a script that checks to see if you are able to connect to the robot
#records the result and print it
    available = is_available(ip)
    
    if available:
        st[txt_key] = "%s is up!" % ip
        trigger = True
    else:
        st[txt_key] = "%s is down!" % ip
        trigger = False
print(st[txt_key])
# ---------- end py ----------
panel_2 = Panel(py.out)

# ---- group: Robot_1
# A cluster is a node made up of multiple other nodes. To access these inner nodes just double click on the component. Inside Tools is everything that sets up the specific tool passed in
# 1) Set up robot
# Here are two value lists that tell our components what robot and tool that we are using.
# If you need to change any of these simply click the drop down and select your desired tool or robot.
# A python node that sets up the parameters of our robot based on the value we pass in from the value list.
# These two bottom PY set up the base frame for the robot (a frame is just a base point and two orthogonal vectors): COMPAS - Frame.
# Set Params is another python node that adds the tool and frame to the robot and sets up a global variable for the robot.
# These set up the axis for the robot.
x_axis = Curve(<curve referenced from the Rhino model>)
y_axis = Curve(<curve referenced from the Rhino model>)
plane = PythonScript(plane_axes=[x_axis, y_axis])  # -> plane; inputs plane_axes: list of Curve
# ---------- plane: Python ----------
import Rhino.Geometry as rg

#Sets up the planes used by the robot (y and x axis passed in)
x_axis, y_axis = plane_axes

x_axis = rg.Line(x_axis.PointAtStart, x_axis.PointAtEnd)
y_axis = rg.Line(y_axis.PointAtStart, y_axis.PointAtEnd)

if x_axis.From.DistanceTo(y_axis.From) < 0.01:
    origin = x_axis.From
    xvec = x_axis.Direction
    yvec = y_axis.Direction
elif x_axis.To.DistanceTo(y_axis.To) < 0.01:
    origin = x_axis.To
    xvec = -x_axis.Direction
    yvec = -y_axis.Direction
elif x_axis.From.DistanceTo(y_axis.To) < 0.01:
    origin = x_axis.From
    xvec = x_axis.Direction
    yvec = -y_axis.Direction
elif x_axis.To.DistanceTo(y_axis.From) < 0.01:
    origin = x_axis.To
    xvec = -x_axis.Direction
    yvec = y_axis.Direction

plane = rg.Plane(origin, xvec, yvec)
# ---------- end plane ----------
base = PythonScript(base_plane=plane)  # -> base_frame, base_plane
# ---------- base: Python ----------
from compas.geometry import Frame
from compas.geometry import Transformation, Rotation
from compas_ghpython import draw_frame
import math
import Rhino.Geometry as rg

# sets up a Frame which plane pasted in

bp = base_plane
base_frame = Frame(bp.Origin, bp.XAxis, bp.YAxis)
# ---------- end base ----------
robot = PythonScript(model=list_2)  # -> robot
# ---------- robot: Python ----------
from ur_online_control.ur.ur10e import UR10e
from ur_online_control.ur.ur10 import UR10
from ur_online_control.ur.ur5 import UR5

from scriptcontext import sticky as st

# sets up the correct model using the following imported scripts
if model == "UR5":
    robot = UR5()
if model == "UR10":
    robot = UR10()
if model == "UR10e":
    robot = UR10e()
# ---------- end robot ----------
tools = Tools(tool_id=list)
set_params = PythonScript(robot=robot, tool=tools, base_frame=base.base_frame)  # -> robot
# ---------- set_params: Python ----------
from ur_online_control.ur.ur10e import UR10e
from scriptcontext import sticky as st
from ur_online_control.ur.tool import Tool
from compas.geometry import Frame

# assigns the robot the specfic tool and base frame
if tool:
    robot.set_tool(tool)
else:
    robot.set_tool(Tool(Frame.worldXY()))  
if base_frame:
    robot.set_base(base_frame)

# creates a global var for the robot
st["robot"] = robot
# ---------- end set_params ----------

# ----
# The robots node on the top is another cluster that selects the correct robot shape (brep and mesh in this case) based on the name.
# 4) Draw the robot
# The draw node is a python component that rotates and translates the robot to the correct position and joint rotation values.
# Draw model with specifc color
joint_configurations = Data(forward_kinematics)
modelname = Data(list_2)
robot_2 = Data(set_params)
robots = Robots(model=modelname)  # -> robot_mesh_2, robot_brep_2
draw = PythonScript(robot=robot_2, configuration=joint_configurations, meshes=robots.robot_mesh_2, breps=robots.robot_brep_2)  # -> out, robot_mesh, tool_mesh; inputs meshes: list of Mesh, breps: list of Brep
# ---------- draw: Python ----------
from scriptcontext import sticky as st
from compas_ghpython import draw_frame


if configuration:
# creates base robot mesh and breps
    if len(robot.model) == 0:
        robot.model = meshes
        robot.model_breps = breps
# Draw position of the robot at new configuration
    tmodel = robot.xdraw(configuration)
    robot_mesh = tmodel[:6]
    tool_mesh = tmodel[6]
# ---------- end draw ----------
preview = CustomPreview(Geometry=draw.robot_mesh, Shader=ColourSwatch(SwatchColor=RGBA(99, 94, 94, 96)))
preview_2 = CustomPreview(Geometry=draw.tool_mesh, Shader=ColourSwatch(SwatchColor=RGBA(204, 78, 78, 96)))

# ----
# 3) Send move command to robot
# Another python node that will send over the script once the send button is hit (uses the ip and port set in the “Set up connect” section).
# This python component that creates the script to send to the robot
number_slider = Slider(0.1, range=0..1)
joint_configurations_2 = Data(forward_kinematics)
movej = PythonScript(joint_configurations=joint_configurations_2, velocity=number_slider)  # -> script, values; inputs joint_configurations: list
# ---------- movej: Python ----------
import ur_online_control.ur_direct as urd

#changes the format of the joint config. so that is reable for the robot
joint_config = ["movej({}, v={})".format(c.values, velocity) for c in joint_configurations]

#sets up the command script for the robot and adds the joint config. 
commands = urd.URCommandScript()
commands.start()
commands.add_lines(joint_config)
commands.end()

#generates the script created above
script = commands.generate()
# ---------- end movej ----------
send = Button()
send_2 = GhPythonScript(script=movej.script, send=send)  # -> out; inputs send: Boolean
# ---------- send_2: Python ----------
from scriptcontext import sticky as st
from ur_online_control.ur_direct import send_script

ur_ip = st["ur_ip"]
ur_port = st["ur_port"]
# sends script if button is hit using the ip and port created in the connection section
if send:
    send_script(script, ur_ip, ur_port)
# ---------- end send_2 ----------

# ==== cluster Tools

# ---- group: measurement tool
geo = Geometry(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)
mesh = Mesh(geo)
brep = Brep(geo)
mjoin = MeshJoin(Meshes=mesh)
xaxis_line = Curve(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)
yaxis_line = Curve(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)
tool = PythonScript(meshes=mjoin, breps=brep, xline=xaxis_line, yline=yaxis_line)  # -> tool; inputs meshes: list of Mesh, breps: list of Brep
# ---------- tool: Python ----------
import Rhino.Geometry as rg
from compas.geometry import Frame
from ur_online_control.ur.tool import Tool

xaxis = rg.Line(xline.PointAtStart, xline.PointAtEnd)
yaxis = rg.Line(yline.PointAtStart, yline.PointAtEnd)

if xaxis.From.DistanceTo(yaxis.From) < 0.01:
    origin = xaxis.From
    xaxis = xaxis.Direction
    yaxis = yaxis.Direction
elif xaxis.To.DistanceTo(yaxis.To) < 0.01:
    origin = xaxis.To
    xaxis = -xaxis.Direction
    yaxis = -yaxis.Direction
elif xaxis.From.DistanceTo(yaxis.To) < 0.01:
    origin = xaxis.From
    xaxis = xaxis.Direction
    yaxis = -yaxis.Direction
elif xaxis.To.DistanceTo(yaxis.From) < 0.01:
    origin = xaxis.To
    xaxis = -xaxis.Direction
    yaxis = yaxis.Direction

xaxis.Unitize()
yaxis.Unitize()

print origin
print xaxis
print yaxis

tcp_frame = Frame(origin, xaxis, yaxis)

tool = Tool(tcp_frame)
tool.model = meshes
tool.model_breps = breps
# ---------- end tool ----------

# ---- group: air pick 15mm
geo_2 = Geometry(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)
mesh_2 = Mesh(geo_2)
brep_2 = Brep(geo_2)
mjoin_2 = MeshJoin(Meshes=mesh_2)
xaxis_line_2 = Curve(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)
yaxis_line_2 = Curve(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)
tool_2 = PythonScript(meshes=mjoin_2, breps=brep_2, xline=xaxis_line_2, yline=yaxis_line_2)  # -> tool; inputs meshes: list of Mesh, breps: list of Brep; same code as tool

# ---- group: electro magnet
geo_3 = Geometry([<brep referenced from the Rhino model> x6])
mesh_3 = Mesh(geo_3)
brep_3 = Brep(geo_3)
mjoin_3 = MeshJoin(Meshes=mesh_3)
xaxis_line_3 = Curve(<curve referenced from the Rhino model>)
yaxis_line_3 = Curve(<curve referenced from the Rhino model>)
tool_3 = PythonScript(meshes=mjoin_3, breps=brep_3, xline=xaxis_line_3, yline=yaxis_line_3)  # -> tool; inputs meshes: list of Mesh, breps: list of Brep; same code as tool

# ---- group: air pick 40mm
geo_4 = Geometry(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)
mesh_4 = Mesh(geo_4)
brep_4 = Brep(geo_4)
mjoin_4 = MeshJoin(Meshes=mesh_4)
xaxis_line_4 = Curve(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)
yaxis_line_4 = Curve(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)
tool_4 = PythonScript(meshes=mjoin_4, breps=brep_4, xline=xaxis_line_4, yline=yaxis_line_4)  # -> tool; inputs meshes: list of Mesh, breps: list of Brep; same code as tool

# ----
tool_id = ClusterInput()
tool_id_2 = Integer(tool_id)
filter = StreamFilter(Gate=tool_id_2, Stream1=tool, Stream2=tool_4, Stream3=tool_2, Stream4=tool_3)
py = PythonScript(tool=filter)  # -> tcp_frame, model
# ---------- py: Python ----------
from compas_ghpython import mesh_draw 

if tool:
    tcp_frame = tool.tcp_frame
    model = tool.model
# ---------- end py ----------
tool_5 = Data(filter)
draw = PythonScript(frame=py.tcp_frame)  # -> G, C
# ---------- draw: Python ----------
import Rhino.Geometry as rg
from System.Drawing import Color

if not size:
    size = 0.1

if frame:
    plane = rg.Plane(rg.Point3d(*list(frame.point)), rg.Vector3d(*list(frame.xaxis)), rg.Vector3d(*list(frame.yaxis)))

    G = []
    G.append(rg.Line(plane.Origin, size * plane.XAxis))
    G.append(rg.Line(plane.Origin, size * plane.YAxis))
    G.append(rg.Line(plane.Origin, size * plane.ZAxis))
    
    C = []
    C.append(Color.FromArgb(255, 0, 0))
    C.append(Color.FromArgb(0, 255, 0))
    C.append(Color.FromArgb(0, 0, 255))
# ---------- end draw ----------
tool_6 = ClusterOutput(tool_5)
preview = CustomPreview(Geometry=py.model, Shader=ColourSwatch(SwatchColor=RGBA(141, 170, 178, 150)))
preview_2 = CustomPreview(Geometry=draw.G, Shader=draw.C)

# ==== cluster Robots
model = ClusterInput()

# ---- group: robot geometry
py = PythonScript(model=model)  # -> n
# ---------- py: Python ----------
import time


if model == "UR5":
    n = 0
if model == "UR10":
    n = 1
if model == "UR10e":
    n = 2

print n
# ---------- end py ----------
ur10e_brep = UR10Brep([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])
ur10_brep = UR10Brep([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])
ur5_brep = UR5Brep([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])
filter = StreamFilter(Gate=py, Stream0=ur5_brep, Stream1=ur10_brep, Stream2=ur10e_brep)

# ----
robot_mesh = Mesh(filter)
robot_brep = Brep(filter)
robot_mesh_2 = ClusterOutput(robot_mesh)
robot_brep_2 = ClusterOutput(robot_brep)
