# Grasshopper definition 03 Movement on a curve.gh (Grasshopper 1.0.7)

# ----
# You are encouraged to edit things in the blue!
# (Also if you are comfortable
# try to play with the other things as well)
list = ValueList({"UR5", "UR10", "UR10e"}, selected="UR5")
reset = Button()
back = Button()
start = Button()
stop = Button()
step = Button()
list_2 = ValueList({"20", "50", "100", "500", "1000", "5000"}, selected="50")

# ---- group: Robot_1
# 2) Set up robot
list_3 = ValueList({"no_tool": 0, "measurement_tool": 1, "air_pick 40mm": 2, "air_pick 15mm": 3, "electromagnet": 4}, selected="air_pick 40mm")
y_axis = Curve(<curve referenced from the Rhino model>)
x_axis = Curve(<curve referenced from the Rhino model>)
robot = PythonScript(model=list)  # -> robot
# ---------- robot: Python ----------
from ur_online_control.ur.ur10e import UR10e
from ur_online_control.ur.ur10 import UR10
from ur_online_control.ur.ur5 import UR5

from scriptcontext import sticky as st

# sets up the correct model using the following imported scripts
if model == "UR5":
    robot = UR5()
if model == "UR10":
    robot = UR10()
if model == "UR10e":
    robot = UR10e()
# ---------- end robot ----------
tools = Tools(tool_id=list_3)
plane = PythonScript(plane_axes=[x_axis, y_axis])  # -> plane; inputs plane_axes: list of Curve
# ---------- plane: Python ----------
import Rhino.Geometry as rg

#Sets up the planes used by the robot (y and x axis passed in)
x_axis, y_axis = plane_axes

x_axis = rg.Line(x_axis.PointAtStart, x_axis.PointAtEnd)
y_axis = rg.Line(y_axis.PointAtStart, y_axis.PointAtEnd)

if x_axis.From.DistanceTo(y_axis.From) < 0.01:
    origin = x_axis.From
    xvec = x_axis.Direction
    yvec = y_axis.Direction
elif x_axis.To.DistanceTo(y_axis.To) < 0.01:
    origin = x_axis.To
    xvec = -x_axis.Direction
    yvec = -y_axis.Direction
elif x_axis.From.DistanceTo(y_axis.To) < 0.01:
    origin = x_axis.From
    xvec = x_axis.Direction
    yvec = -y_axis.Direction
elif x_axis.To.DistanceTo(y_axis.From) < 0.01:
    origin = x_axis.To
    xvec = -x_axis.Direction
    yvec = y_axis.Direction

plane = rg.Plane(origin, xvec, yvec)
# ---------- end plane ----------
base = PythonScript(base_plane=plane)  # -> base_frame, base_plane
# ---------- base: Python ----------
from compas.geometry import Frame
from compas.geometry import Transformation, Rotation
from compas_ghpython import draw_frame
import math
import Rhino.Geometry as rg

# sets up a Frame which plane pasted in

bp = base_plane
base_frame = Frame(bp.Origin, bp.XAxis, bp.YAxis)
# ---------- end base ----------
set_params = PythonScript(robot=robot, tool=tools, base_frame=base.base_frame)  # -> robot
# ---------- set_params: Python ----------
from ur_online_control.ur.ur10e import UR10e
from scriptcontext import sticky as st
from ur_online_control.ur.tool import Tool
from compas.geometry import Frame

# assigns the robot the specfic tool and base frame
if tool:
    robot.set_tool(tool)
else:
    robot.set_tool(Tool(Frame.worldXY()))  
if base_frame:
    robot.set_base(base_frame)

# creates a global var for the robot
st["robot"] = robot
# ---------- end set_params ----------

# ----
# 1) Set up connection
panel = Panel("Same as before")

server_ip = ValueList({"192.168.10.44", "192.168.10.12", "192.168.10.11", "192.168.10.10", "192.168.10.3", "192.168.10.2", "192.168.10.1", "127.0.0.1", "192.168.10.111"}, selected="192.168.10.2")
server_port = ValueList({"50002", "50003", "50004", "50005"}, selected="50002")
ur_ip = ValueList({"192.168.10.10", "192.168.10.20", "192.168.10.11", "192.168.10.12", "127.0.0.1", "192.168.10.111"}, selected="192.168.10.11")
ur_port = ValueList({"30002"}, selected="30002")
globals = PythonScript(server_address=server_ip, server_port=server_port, ur_ip=ur_ip, ur_port=ur_port, clear=Button())  # inputs server_port: Int32
# ---------- globals: Python ----------
from scriptcontext import sticky as st

#set up the variables used to set up the robot
st["server_address"] = server_address
st["server_port"] = server_port
st["ur_ip"] = ur_ip
st["ur_port"] = ur_port

#clear the variables
if clear:
    st.clear()
# ---------- end globals ----------

ping = Button()
py = PythonScript(ip=ur_ip, ping=ping)  # -> out, trigger
# ---------- py: Python ----------
from scriptcontext import sticky as st
from ur_online_control.ur_direct import is_available

guid = str(ghenv.Component.InstanceGuid)
txt_key = "txt_" + guid


if txt_key not in st:
    st[txt_key] = ""
    

#if the ping button is hit run the following code
if ping:

#runs a script that checks to see if you are able to connect to the robot
#records the result and print it
    available = is_available(ip)
    
    if available:
        st[txt_key] = "%s is up!" % ip
        trigger = True
    else:
        st[txt_key] = "%s is down!" % ip
        trigger = False
print(st[txt_key])
# ---------- end py ----------
panel_2 = Panel(py.out)

panel_3 = Panel("Same as before")

# ----
# 3) Set up curve to follow
# Finds the configurations of the robot for each specific point.
# Curve for robot to follow
# Robot arms can move to a certain point in many different ways. This number selects the specfic arm configuration for the robot.
crv = Curve(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)
panel_4 = Panel("Broken into  points")
divide = DivideCurve(Curve=crv, Count=10, Kinks=False)  # -> Points, Tangents, Parameters
idx = Slider(0, range=0..7)
robot_2 = Data(set_params)
# In this file you will create a curve for the robot to follow. It will be sent to the robot online
inverse_multiple = PythonScript(robot=robot_2, points=divide.Points, configuration_idx=idx)  # -> configurations; inputs points: list, configuration_idx: Int32, init_configuration: list
# ---------- inverse_multiple: Python ----------
from compas_ghpython import unload_modules
unload_modules('ur_online_control')

import Rhino.Geometry as rg
from compas.geometry import Frame 
from compas.geometry import Transformation
from compas_ghpython import draw_frame
from ur_online_control.ur.kinematics import calculate_configurations_for_path, format_joint_positions


# TODO this must be optimized! matrix multiplication!


# finds the Frame from each of the points
frames_tool0_RCS = []
for point in points:
    tcp_WCS = Frame(point, [1,0,0] , [0,-1,0])
    tcp_RCS = robot.get_frame_in_RCS(tcp_WCS)
    frames_tool0_RCS.append(robot.get_tool0_frame_from_tcp_frame(tcp_RCS))

# coverts those frames into configurations for the robot arm
# as we are not giving specifc joint values multiple configurations are created
configurations = calculate_configurations_for_path(frames_tool0_RCS, robot, init_configuration)




# here the configuration is selected  of the joints due to the index passed in
configurations = configurations[min([configuration_idx, len(configurations) - 1])]
# checks to see if robot will run into the table 
# if it will reset the path
for j in range(len(configurations)):
    for i in range(len(configurations[j].values)):
        print configurations[j].values[1]
        if i == 1:
            if configurations[j].values[1] > 0:
                configurations[j].values[1]-= 6.28318530718

print configurations
# ---------- end inverse_multiple ----------

# ----
# 4) Send the movements to the robot
# With this value list you can either choose to send the robot one configuration or all of them
# Two python scripts same as 02 Simple Joints
# Index of the specfic configuration sent (active depending on value list)
idx_2 = Slider(0, range=0..100)
joint_configurations = Data(inverse_multiple)
item = ListItem(List=joint_configurations, Index=idx_2, Wrap=True)
list_4 = ValueList({"send all positions": 0, "send only one position": 1}, selected="send only one position")
filter = StreamFilter(Gate=list_4, Stream0=joint_configurations, Stream1=item)
movej = PythonScript(joint_configurations=filter, velocity=Slider(0.37, range=0..1))  # -> script, values; inputs joint_configurations: list
# ---------- movej: Python ----------
import ur_online_control.ur_direct as urd
print joint_configurations
print joint_configurations[0].values
for i in range(len(joint_configurations[0].values)):
    print joint_configurations[0].values[1]
    if i == 1:
        if joint_configurations[0].values[1] > 0:
            joint_configurations[0].values[1]-= 6.28318530718
#changes the format of the joint config. so that is reable for the robot
joint_config = ["movej({}, v={})".format(c.values, velocity) for c in joint_configurations]
print joint_configurations
#sets up the command script for the robot and adds the joint config. 
commands = urd.URCommandScript()
commands.start()
commands.add_lines(joint_config)
commands.end()

#generates the script created above
script = commands.generate()
# ---------- end movej ----------
send = Button()
send_2 = GhPythonScript(script=movej.script, send=send)  # -> out; inputs send: Boolean
# ---------- send_2: Python ----------
from scriptcontext import sticky as st
from ur_online_control.ur_direct import send_script

ur_ip = st["ur_ip"]
ur_port = st["ur_port"]
# sends script if button is hit using the ip and port created in the connection section
if send:
    send_script(script, ur_ip, ur_port)
# ---------- end send_2 ----------

# ----
# 5) Draw the robot movement
# Selects one configuration based on the buttons pressed. If start is pressed will run through configurations
# Nodes same as 02 Simple Joints
counter = CountThroughList(L=inverse_multiple, start=start, stop=stop, step=step, step_back=back, reset=reset, interval=list_2)  # -> item, counter; inputs L: list, start: Boolean, stop: Boolean, step_back: Boolean
# ---------- counter: Python ----------
from scriptcontext import sticky as st
from compas_ghpython import update_component


# create variable name for the counter and the boolean that is either true if
# the counter is running or false if not

guid = str(ghenv.Component.InstanceGuid)
counter_key = "counter_" + guid
running_key = "running_" + guid


# depending on which button is clicked changes the counter or running boolean
# accordingly 
if counter_key not in st:
    st[counter_key] = 0

if running_key not in st:
    st[running_key] = False

if start:
    st[running_key] = True

if stop:
    st[running_key] = False

if step:
    if st[counter_key] < len(L) - 1:
        st[counter_key] += 1

if step_back:
    if st[counter_key] < len(L) - 1:
        st[counter_key] -= 1

if reset:
    st[counter_key] = 0

if len(L):
    item = L[st[counter_key]]

if st[running_key]:
    if st[counter_key] < len(L) - 1:
        st[counter_key] += 1
        update_component(ghenv, interval)
    else:
        st[counter_key] = 0
        st[running_key] = False

counter = st[counter_key]
# ---------- end counter ----------
robots = Robots(model=list)  # -> robot_mesh_2, robot_brep_2
draw = PythonScript(robot=set_params, configuration=counter.item, meshes=robots.robot_mesh_2, breps=robots.robot_brep_2)  # -> out, robot_mesh, tool_mesh; inputs meshes: list of Mesh, breps: list of Brep
# ---------- draw: Python ----------
from scriptcontext import sticky as st
from compas_ghpython import draw_frame


if configuration:
    #sets the meshes and breps of the robot
    if len(robot.model) == 0:
        robot.model = meshes
        robot.model_breps = breps
    print configuration
    #draws the robot at it's new configuration
    tmodel = robot.xdraw(configuration)
    robot_mesh = tmodel[:6]
    tool_mesh = tmodel[6]
# ---------- end draw ----------
robot_mesh = Mesh(draw.robot_mesh)
tool_mesh = Mesh(draw.tool_mesh)
preview = CustomPreview(Geometry=robot_mesh, Shader=ColourSwatch(SwatchColor=RGBA(99, 94, 94, 96)))
preview_2 = CustomPreview(Geometry=tool_mesh, Shader=ColourSwatch(SwatchColor=RGBA(204, 78, 78, 96)))

idx_3 = Slider(2, range=0..7)

# ==== cluster Robots
model = ClusterInput()

# ---- group: robot geometry
py = PythonScript(model=model)  # -> n
# ---------- py: Python ----------
import time


if model == "UR5":
    n = 0
if model == "UR10":
    n = 1
if model == "UR10e":
    n = 2

print n
# ---------- end py ----------
ur10e_brep = UR10Brep([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])
ur10_brep = UR10Brep([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])
ur5_brep = UR5Brep([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])
filter = StreamFilter(Gate=py, Stream0=ur5_brep, Stream1=ur10_brep, Stream2=ur10e_brep)

# ----
robot_mesh = Mesh(filter)
robot_brep = Brep(filter)
robot_mesh_2 = ClusterOutput(robot_mesh)
robot_brep_2 = ClusterOutput(robot_brep)

# ==== cluster Tools

# ---- group: measurement tool
geo = Geometry(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)
mesh = Mesh(geo)
brep = Brep(geo)
mjoin = MeshJoin(Meshes=mesh)
xaxis_line = Curve(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)
yaxis_line = Curve(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)
tool = PythonScript(meshes=mjoin, breps=brep, xline=xaxis_line, yline=yaxis_line)  # -> tool; inputs meshes: list of Mesh, breps: list of Brep
# ---------- tool: Python ----------
import Rhino.Geometry as rg
from compas.geometry import Frame
from ur_online_control.ur.tool import Tool

xaxis = rg.Line(xline.PointAtStart, xline.PointAtEnd)
yaxis = rg.Line(yline.PointAtStart, yline.PointAtEnd)

if xaxis.From.DistanceTo(yaxis.From) < 0.01:
    origin = xaxis.From
    xaxis = xaxis.Direction
    yaxis = yaxis.Direction
elif xaxis.To.DistanceTo(yaxis.To) < 0.01:
    origin = xaxis.To
    xaxis = -xaxis.Direction
    yaxis = -yaxis.Direction
elif xaxis.From.DistanceTo(yaxis.To) < 0.01:
    origin = xaxis.From
    xaxis = xaxis.Direction
    yaxis = -yaxis.Direction
elif xaxis.To.DistanceTo(yaxis.From) < 0.01:
    origin = xaxis.To
    xaxis = -xaxis.Direction
    yaxis = yaxis.Direction

xaxis.Unitize()
yaxis.Unitize()

print origin
print xaxis
print yaxis

tcp_frame = Frame(origin, xaxis, yaxis)

tool = Tool(tcp_frame)
tool.model = meshes
tool.model_breps = breps
# ---------- end tool ----------

# ---- group: air pick 15mm
geo_2 = Geometry(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)
mesh_2 = Mesh(geo_2)
brep_2 = Brep(geo_2)
mjoin_2 = MeshJoin(Meshes=mesh_2)
xaxis_line_2 = Curve(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)
yaxis_line_2 = Curve(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)
tool_2 = PythonScript(meshes=mjoin_2, breps=brep_2, xline=xaxis_line_2, yline=yaxis_line_2)  # -> tool; inputs meshes: list of Mesh, breps: list of Brep; same code as tool

# ---- group: electro magnet
geo_3 = Geometry([<brep referenced from the Rhino model> x6])
mesh_3 = Mesh(geo_3)
brep_3 = Brep(geo_3)
mjoin_3 = MeshJoin(Meshes=mesh_3)
xaxis_line_3 = Curve(<curve referenced from the Rhino model>)
yaxis_line_3 = Curve(<curve referenced from the Rhino model>)
tool_3 = PythonScript(meshes=mjoin_3, breps=brep_3, xline=xaxis_line_3, yline=yaxis_line_3)  # -> tool; inputs meshes: list of Mesh, breps: list of Brep; same code as tool

# ---- group: air pick 40mm
geo_4 = Geometry(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)
mesh_4 = Mesh(geo_4)
brep_4 = Brep(geo_4)
mjoin_4 = MeshJoin(Meshes=mesh_4)
xaxis_line_4 = Curve(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)
yaxis_line_4 = Curve(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)
tool_4 = PythonScript(meshes=mjoin_4, breps=brep_4, xline=xaxis_line_4, yline=yaxis_line_4)  # -> tool; inputs meshes: list of Mesh, breps: list of Brep; same code as tool

# ----
tool_id = ClusterInput()
tool_id_2 = Integer(tool_id)
filter = StreamFilter(Gate=tool_id_2, Stream1=tool, Stream2=tool_4, Stream3=tool_2, Stream4=tool_3)
py = PythonScript(tool=filter)  # -> tcp_frame, model
# ---------- py: Python ----------
from compas_ghpython import mesh_draw 

if tool:
    tcp_frame = tool.tcp_frame
    model = tool.model
# ---------- end py ----------
tool_5 = Data(filter)
draw = PythonScript(frame=py.tcp_frame)  # -> G, C
# ---------- draw: Python ----------
import Rhino.Geometry as rg
from System.Drawing import Color

if not size:
    size = 0.1

if frame:
    plane = rg.Plane(rg.Point3d(*list(frame.point)), rg.Vector3d(*list(frame.xaxis)), rg.Vector3d(*list(frame.yaxis)))

    G = []
    G.append(rg.Line(plane.Origin, size * plane.XAxis))
    G.append(rg.Line(plane.Origin, size * plane.YAxis))
    G.append(rg.Line(plane.Origin, size * plane.ZAxis))
    
    C = []
    C.append(Color.FromArgb(255, 0, 0))
    C.append(Color.FromArgb(0, 255, 0))
    C.append(Color.FromArgb(0, 0, 255))
# ---------- end draw ----------
tool_6 = ClusterOutput(tool_5)
preview = CustomPreview(Geometry=py.model, Shader=ColourSwatch(SwatchColor=RGBA(141, 170, 178, 150)))
preview_2 = CustomPreview(Geometry=draw.G, Shader=draw.C)
