# Grasshopper definition 06 Drawing a curve assembly.gh (Grasshopper 1.0.7)

# ---- group: Robot_1
# 1. load robot model
# 2. set tool
# 3. set basis
# Here, you can set the basis for your robot
list = ValueList({"no_tool": 0, "measurement_tool": 1, "air_pick 40mm": 2, "air_pick 15mm": 3, "electromagnet": 4, "drawing tool": 5}, selected="drawing tool")
x_axis = Curve(<curve referenced from the Rhino model>)
y_axis = Curve(<curve referenced from the Rhino model>)
list_2 = ValueList({"UR5", "UR10", "UR10e"}, selected="UR5")
tools = Tools(tool_id=list)
plane = PythonScript(plane_axes=[x_axis, y_axis])  # -> plane; inputs plane_axes: list of Curve
# ---------- plane: Python ----------
import Rhino.Geometry as rg

x_axis, y_axis = plane_axes

x_axis = rg.Line(x_axis.PointAtStart, x_axis.PointAtEnd)
y_axis = rg.Line(y_axis.PointAtStart, y_axis.PointAtEnd)

if x_axis.From.DistanceTo(y_axis.From) < 0.01:
    origin = x_axis.From
    xvec = x_axis.Direction
    yvec = y_axis.Direction
elif x_axis.To.DistanceTo(y_axis.To) < 0.01:
    origin = x_axis.To
    xvec = -x_axis.Direction
    yvec = -y_axis.Direction
elif x_axis.From.DistanceTo(y_axis.To) < 0.01:
    origin = x_axis.From
    xvec = x_axis.Direction
    yvec = -y_axis.Direction
elif x_axis.To.DistanceTo(y_axis.From) < 0.01:
    origin = x_axis.To
    xvec = -x_axis.Direction
    yvec = y_axis.Direction

plane = rg.Plane(origin, xvec, yvec)
# ---------- end plane ----------
robot = PythonScript(model=list_2)  # -> robot
# ---------- robot: Python ----------
from ur_online_control.ur.ur10e import UR10e
from ur_online_control.ur.ur10 import UR10
from ur_online_control.ur.ur5 import UR5

from scriptcontext import sticky as st


if model == "UR5":
    robot = UR5()
if model == "UR10":
    robot = UR10()
if model == "UR10e":
    robot = UR10e()
# ---------- end robot ----------
base = PythonScript(base_plane=plane)  # -> base_frame, base_plane
# ---------- base: Python ----------
from compas.geometry import Frame
from compas.geometry import Transformation, Rotation
from compas_ghpython import draw_frame
import math
import Rhino.Geometry as rg


"""
origin = [0,0,0]
xaxis = [1,0,0]
yaxis = [0,1,0]

base_frame = Frame(list(origin), list(xaxis), list(yaxis))
"""

bp = base_plane
base_frame = Frame(bp.Origin, bp.XAxis, bp.YAxis)
# ---------- end base ----------
set_params = PythonScript(robot=robot, tool=tools, base_frame=base.base_frame)  # -> robot
# ---------- set_params: Python ----------
from ur_online_control.ur.ur10e import UR10e
from scriptcontext import sticky as st
from ur_online_control.ur.tool import Tool
from compas.geometry import Frame
print tool,robot, base_frame

if tool:
    robot.set_tool(tool)
else:
    robot.set_tool(Tool(Frame.worldXY()))  
if base_frame:
    robot.set_base(base_frame)

st["robot"] = robot
# ---------- end set_params ----------

# ----
server_port = ValueList({"50002", "50003", "50004", "50005"}, selected="50002")
ur_port = ValueList({"30002"}, selected="30002")

# ----
# --> Set your IP address
# --> Set robot IP address
server_ip = ValueList({"192.168.10.44", "192.168.10.12", "192.168.10.11", "192.168.10.10", "192.168.10.3", "192.168.10.2", "192.168.10.1", "127.0.0.1", "192.168.10.111"}, selected="192.168.10.2")
ur_ip = ValueList({"192.168.10.10", "192.168.10.20", "192.168.10.11", "192.168.10.12", "127.0.0.1", "192.168.10.111"}, selected="192.168.10.11")
globals = PythonScript(server_address=server_ip, server_port=server_port, ur_ip=ur_ip, ur_port=ur_port, clear=Button())  # inputs server_port: Int32
# ---------- globals: Python ----------
from scriptcontext import sticky as st

st["server_address"] = server_address
st["server_port"] = server_port

st["ur_ip"] = ur_ip
st["ur_port"] = ur_port

if clear:
    st.clear()
# ---------- end globals ----------

# ----
# Check if UR robot
#  is available
ping = Button()
py = PythonScript(ip=ur_ip, ping=ping)  # -> out, trigger
# ---------- py: Python ----------
from scriptcontext import sticky as st
from ur_online_control.ur_direct import is_available

guid = str(ghenv.Component.InstanceGuid)
txt_key = "txt_" + guid
if txt_key not in st:
    st[txt_key] = ""

if ping:
    
    available = is_available(ip)
    
    if available:
        st[txt_key] = "%s is up!" % ip
        trigger = True
    else:
        st[txt_key] = "%s is down!" % ip
        trigger = False

print(st[txt_key])
# ---------- end py ----------
panel = Panel(py.out)

# ----
# divide the curve up into points
# set the curve here
# find out the configurations for the robot to follow the curve
number_slider = Slider(43, range=0..50)
crv = Curve(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)
divide = DivideCurve(Curve=crv, Count=number_slider, Kinks=False)  # -> Points, Tangents, Parameters

list_3 = ValueList({"20", "50", "100", "500", "1000", "5000"}, selected="20")
back = Button()
reset = Button()
start = Button()
stop = Button()
step = Button()
full = Button()

# ---- group: Element
# 2.
# Element
# Define an element and its dimensions
block_def = GhPythonScript()  # -> out, block
# ---------- block_def: Python ----------
import os
import sys
import json

from compas.geometry import Frame
from compas.geometry import Vector
from compas.geometry import Box
from ur_online_control.ur.configuration import Configuration

from assembly_information_model.assembly import Element


#definition: units in meter
#width = 0.02
#length = 0.23
#height = 0.005

width = 0.08
length = 0.05
height = 0.04

#tolerance_vector = Vector(0, 0, 0.001)
#savelevel_vector = Vector(0, 0, 0.05)

#picking_frame = Frame([-0.43, 0, height], [1, 0, 0], [0, 1, 0])
#picking_configuration = Configuration.from_revolute_values([-6.027, 4.443, -2.313, 5.724, 1.571, -2.885])

# block
box_frame = Frame([width/2, length/2, height/2], [1, 0, 0], [0, 1, 0]) #center of the box frame 
box = Box(box_frame, width, length, height) 
tool_frame = Frame([width/2, length/2, height], [1, 0, 0], [0, -1, 0])
block = Element.from_shape(box, tool_frame)
block.id = "short"
# ---------- end block_def ----------

# ----
pln = Plane(Plane(origin=(0.04, 0.025, 0.04), x=(1, 0, 0), y=(0, -1, 0)))
show = BooleanToggle(True)

reset_2 = Button()
back_2 = Button()
start_2 = Button()
stop_2 = Button()
step_2 = Button()
full_2 = Button()
list_4 = ValueList({"20", "50", "100", "500", "1000", "5000"}, selected="50")

# ---- group: Calculate joint positions for path
idx = Slider(2, range=0..7)

# ---- group: input
robot_2 = Data(set_params)

# ---- group: Assembly
cp = Plane(PlaneXY(0.6, 0.2, 0))

# ----
generate_assembly = GhPythonScript(centerplane=cp, pickUpObject=block_def.block, curvePts=divide.Points)  # -> out, assembly; inputs curvePts: list of Plane
# ---------- generate_assembly: Python ----------
import Rhino.Geometry as rg
import math
from scriptcontext import sticky as st


from compas.geometry import Frame
from compas.geometry import Transformation
from compas.geometry import Rotation
from compas.geometry import Translation
from compas.geometry import Point

from compas_ghpython.geometry import xtransformed
from compas_ghpython import draw_frame

from assembly_information_model.assembly import Assembly
from assembly_information_model.assembly import Element

import Rhino.Geometry as rg

# initialize an empty assembly class
assembly = Assembly()

planes = [] # just for vizualisation

cp = centerplane
cf = Frame(cp.Origin, cp.XAxis, cp.YAxis)


for p in curvePts:
    f = Frame((p.Origin), -p.XAxis, -p.YAxis)
    print p.XAxis
    
    T = Transformation.from_frame_to_frame(Frame.worldXY(), f)
    print pickUpObject
    new_block = pickUpObject.transformed(T)
    assembly.add_element(new_block, robot=1)
    
for key, element, data in assembly.elements(data=True):
    print key, element, data

'''
for i in range(1): # loop through the number of layers i
    
    axis = cf.zaxis
    angle = math.radians(i*3)
    
    R = Rotation.from_axis_and_angle(axis, angle, point=cp.Origin) #Calculates a ``Rotation`` from a rotation axis and an angle and an optional point of rotation.
    T = Translation([0,0,0.005*i])
    
    cft = cf.transformed(R * T) #transforms the origin plane
    
    if i%2 == 0: 
        R = Rotation.from_axis_and_angle(cft.zaxis, math.radians(90), point=cft.point)
        cft = cft.transformed(R)
       
    add = math.sin(i/5)*0.015
    
    o1 = cft.point + cft.yaxis*(0.075+add)
    o2 = cft.point - cft.yaxis*(0.075+add)
    
    f1 = Frame(o1, cft.xaxis, cft.yaxis)
    f2 = Frame(o2, cft.xaxis, cft.yaxis)
    
    planes.append(draw_frame(f1))
    planes.append(draw_frame(f2))
    
    T1 = Transformation.from_frame_to_frame(Frame.worldXY(), f1)
    T2 = Transformation.from_frame_to_frame(Frame.worldXY(), f2)
    
    # create new instances of the element
    new_block_1 = pickUpObject.transformed(T1) #returns a deep copy of the initial element at the new location of the frame
    new_block_2 = pickUpObject.transformed(T2)

    assembly.add_element(new_block_1, robot=1)
    assembly.add_element(new_block_2, robot=1)
    
    #assembly.add_element(my_element, group=j, type="horiz", state=100)
    for key, element, data in assembly.elements(data=True):
        print key, element, data
'''
# ---------- end generate_assembly ----------

# ---- group: Assembly (continued)
path_mapping = GhPythonScript(assembly=generate_assembly.assembly, pick_up_plane_WCS=pln)  # -> out, trajectories, assembly; inputs pick_up_plane_WCS: Plane
# ---------- path_mapping: Python ----------
from scriptcontext import sticky as st
from compas.geometry import Frame, Translation
from compas_ghpython import draw_frame

import Rhino.Geometry as rg


""" Procedure 
00. Safe plane above pickup plane
10. Pickup plane
20. Safe plane above pickup plane
30. Safe plane above release plane
40. Release plane
50. Safe plane above pickup plane
"""

trajectories = []
pup = pick_up_plane_WCS
pickup_frame = Frame(pup.Origin, pup.XAxis, pup.YAxis)

safe_level = 0.1
stack_num = 10
y_loc = 0

for key, element, data in assembly.elements(data=True):
    width = element._source.ysize
    length = element._source.xsize
    height = element._source.zsize
    
    '''
    # Linear array (stacks) of pickup frame locations in negative world z direction and positive world y direction
    full_stack_height = stack_num*height
    current_stack_height = full_stack_height - (key%stack_num)*height
    if key%stack_num == 0:
        y_loc += width
    T = Translation([0, y_loc, current_stack_height])
    '''
    
    element_pickup = pickup_frame #.transformed(T)
    
    _10frame = element_pickup
    _40frame = element.tool_frame
    
    _00frame = _10frame.transformed(Translation(_10frame.zaxis*-safe_level))
    _20frame = _00frame
    
    _30frame = _40frame.transformed(Translation(_40frame.zaxis*-safe_level))
    _50frame = _30frame
    
    element.path = [_00frame, _10frame, _20frame, _30frame, _40frame, _50frame]
    trajectories.extend([draw_frame(frame) for frame in element.path])
# ---------- end path_mapping ----------
pln_2 = Plane(path_mapping.trajectories)

# ----
obj_position = CountThroughList(
    assembly=path_mapping.assembly,
    start=start,
    stop=stop,
    step=step,
    step_back=back,
    reset=reset,
    full=full,
    interval=list_3)  # -> item, counter; inputs start: Boolean, stop: Boolean, step_back: Boolean
# ---------- obj_position: Python ----------
from scriptcontext import sticky as st
from compas_ghpython import update_component


L = list(assembly.elements())
# store data in component
guid = str(ghenv.Component.InstanceGuid)
counter_key = "counter_" + guid
running_key = "running_" + guid

if counter_key not in st:
    st[counter_key] = 0

if running_key not in st:
    st[running_key] = False
    

if st[running_key]:
    if st[counter_key] < len(L) - 1:
        st[counter_key] += 1
        update_component(ghenv, interval)
    else:
        st[counter_key] = 0
        st[running_key] = False
    
    
if start:
    st[running_key] = True

if stop:
    st[running_key] = False

if step:
    if st[counter_key] < len(L) - 1:
        st[counter_key] += 1

if step_back:
    if st[counter_key] < len(L) - 1:
        st[counter_key] -= 1

if reset:
    st[counter_key] = 0

if full:
    st[counter_key] = len(L)-1

if len(L):
    item = L[st[counter_key]]



#st["visualisation_counter"] = st[counter_key]
counter = st[counter_key]
# ---------- end obj_position ----------

# ---- group: Visualise
# 1. Visualise the entire assembly.
# 2. Visualise the assembly process by setting a counter and a speed.
show_2 = BooleanToggle(False)
show_3 = BooleanToggle(False)
idx_2 = Panel(obj_position.counter)
draw = PythonScript(assembly=path_mapping.assembly, show_all=show_2, show_counter=show_3, show_one=show, counter=idx_2)  # -> out, G, tool_planes_WCS, path_planes_WCS, current_tool_plane, current_path_planes; inputs counter: Int32
# ---------- draw: Python ----------
import os
import sys

import math

from compas_ghpython.artists import MeshArtist
from compas_ghpython import draw_frame

#from assembly_information_model.artist import AssemblyArtist


G = []

key_index = assembly.network.key_index()
keys = [key_index[key] for key in assembly.network.nodes()]

elements = [assembly.element(key) for key in keys] 

tool_planes_WCS = [draw_frame(e.tool_frame) for e in elements]
path_planes_WCS = [draw_frame(t_plane) for element in elements for t_plane in element.path]

current_tool_plane = tool_planes_WCS[counter]
current_path_planes = [draw_frame(plane) for plane in assembly.element(counter).path]

if show_all and not show_counter:
    for element in elements:
        artist = MeshArtist(element.mesh)
        mesh = artist.draw_mesh()
        G.append(mesh)

if show_counter:
    for element in elements[0:counter+1]:
        artist = MeshArtist(element.mesh)
        mesh = artist.draw_mesh()
        G.append(mesh)


if show_one:
    element =  elements[counter]
    artist = MeshArtist(element.mesh)
    mesh = artist.draw_mesh()
    G.append(mesh)
# ---------- end draw ----------
pln_3 = Plane(draw.path_planes_WCS)
geo = Geometry(draw.G)
pln_4 = Plane(draw.tool_planes_WCS)
pln_5 = Plane(draw.current_tool_plane)
pln_6 = Plane(draw.current_path_planes)
preview = CustomPreview(Geometry=geo, Shader=ColourSwatch(SwatchColor=RGBA(255, 186, 220, 146)))
preview_2 = CustomPreview(Geometry=pln_3, Shader=ColourSwatch(SwatchColor=RGBA(209, 209, 209, 178)))

# ---- group: input (continued)
plane_wcs = Plane(draw.current_tool_plane)

# ---- group: Calculate joint positions for path (continued)
inverse_multiple = PythonScript(robot=robot_2, planes_WCS=draw.current_path_planes, configuration_idx=idx)  # -> configurations; inputs planes_WCS: list, configuration_idx: Int32, init_configuration: list
# ---------- inverse_multiple: Python ----------
from compas_ghpython import unload_modules
unload_modules('ur_online_control')

import Rhino.Geometry as rg
from compas.geometry import Frame 
from compas.geometry import Transformation
from compas_ghpython import draw_frame
from ur_online_control.ur.kinematics import calculate_configurations_for_path, format_joint_positions


#print init_configuration

# TODO this must be optimized! matrix multiplication!
frames_tool0_RCS = []
for plane_WCS in planes_WCS:
    tcp_WCS = Frame(plane_WCS.Origin, plane_WCS.XAxis, plane_WCS.YAxis)
    print plane_WCS.Origin
    tcp_RCS = robot.get_frame_in_RCS(tcp_WCS)
    frames_tool0_RCS.append(robot.get_tool0_frame_from_tcp_frame(tcp_RCS))
    
#configurations = calculate_configurations_for_path(frames_tool0_RCS, robot.params, init_configuration)
configurations = calculate_configurations_for_path(frames_tool0_RCS, robot, init_configuration)
#print configurations
#print configurations
configurations = configurations[min([configuration_idx, len(configurations) - 1])]
print configurations
def format(numbers, k=4):
    #numbers = format_joint_positions(numbers)
    return "[" + ", ".join([("%." + str(k) + "f") % n for n in numbers]) + "]"
# ---------- end inverse_multiple ----------
counter = CountThroughList(
    L=inverse_multiple,
    start=start_2,
    stop=stop_2,
    step=step_2,
    step_back=back_2,
    reset=reset_2,
    full=full_2,
    interval=list_4)  # -> item, counter; inputs L: list, start: Boolean, stop: Boolean, step_back: Boolean
# ---------- counter: Python ----------
from scriptcontext import sticky as st
from compas_ghpython import update_component


# store data in component
guid = str(ghenv.Component.InstanceGuid)
counter_key = "counter_" + guid
running_key = "running_" + guid

if counter_key not in st:
    st[counter_key] = 0

if running_key not in st:
    st[running_key] = False

if start:
    st[running_key] = True

if stop:
    st[running_key] = False

if step:
    if st[counter_key] < len(L) - 1:
        st[counter_key] += 1

if step_back:
    if st[counter_key] < len(L) - 1:
        st[counter_key] -= 1

if reset:
    st[counter_key] = 0

if full:
    st[counter_key] = len(L)-1

if len(L):
    item = L[st[counter_key]]

if st[running_key]:
    if st[counter_key] < len(L) - 1:
        st[counter_key] += 1
        update_component(ghenv, interval)
    else:
        st[counter_key] = 0
        st[running_key] = False

#st["visualisation_counter"] = st[counter_key]
counter = st[counter_key]
# ---------- end counter ----------

# ---- group: Visualise
robots = Robots(model=list_2)  # -> robot_mesh_2, robot_brep_2
show_brep = BooleanToggle(False)
draw_2 = PythonScript(robot=robot_2, configuration=counter.item, meshes=robots.robot_mesh_2, breps=robots.robot_brep_2, show_brep=show_brep)  # -> out, robot_mesh, tool_mesh, robot_brep, tool_brep, tool0_plane, tcp_plane; inputs meshes: list of Mesh, breps: list of Brep
# ---------- draw_2: Python ----------
from scriptcontext import sticky as st
from compas_ghpython import draw_frame


if configuration:
    if len(robot.model) == 0:
        robot.model = meshes
        robot.model_breps = breps
        #robot_brep, tool_brep, robot_mesh, tool_mesh = []
#    
    tmodel = robot.xdraw(configuration)
    robot_mesh = tmodel[:6]
    tool_mesh = tmodel[6]
    
    if show_brep:
        tmodel = robot.xdraw_brep(configuration)
        robot_brep = tmodel[:6]
        tool_brep = tmodel[6]
        robot_mesh = []
        tool_mesh = []
    
    T0, T1, T2, T3, T4, T5 = robot.get_forward_transformations(configuration)

    tool0_frame, tcp_frame = robot.get_transformed_tool_frames(T5)
    tool0_plane = draw_frame(tool0_frame)
    tcp_plane = draw_frame(tcp_frame)
# ---------- end draw_2 ----------
tool0_plane = Plane(draw_2.tool0_plane)
robot_mesh = Mesh(draw_2.robot_mesh)
tool_mesh = Mesh(draw_2.tool_mesh)
robot_brep = Brep(draw_2.robot_brep)
tool_brep = Brep(draw_2.tool_brep)
tcp_plane = Plane(draw_2.tcp_plane)
draw_3 = RepresentPlaneAsLines(plane=[tcp_plane, tool0_plane], size=0.1)  # -> G, C
# ---------- draw_3: Python ----------
import Rhino.Geometry as rg
from System.Drawing import Color

if plane:

    G = []
    G.append(rg.Line(plane.Origin, size * plane.XAxis))
    G.append(rg.Line(plane.Origin, size * plane.YAxis))
    G.append(rg.Line(plane.Origin, size * plane.ZAxis))
    
    C = []
    C.append(Color.FromArgb(255, 0, 0))
    C.append(Color.FromArgb(0, 255, 0))
    C.append(Color.FromArgb(0, 0, 255))
# ---------- end draw_3 ----------
preview_3 = CustomPreview(Geometry=draw_3.G, Shader=draw_3.C)
preview_4 = CustomPreview(Geometry=[tool_mesh, tool_brep], Shader=ColourSwatch(SwatchColor=RGBA(204, 78, 78, 96)))
preview_5 = CustomPreview(Geometry=[robot_mesh, robot_brep], Shader=ColourSwatch(SwatchColor=RGBA(99, 94, 94, 96)))

# ----
# Fabrication
number_slider_2 = Slider(50, range=0..300)
# 4.
number_slider_3 = Slider(20, range=0..100)
send_single_task = Button()
exit_at_index = BooleanToggle(False)
stop_server = Button()
stop_robot = Button()
set_tasks = Button()
start_3 = Button()
init = Button()
fabricate = GhPythonScript(
    assembly=path_mapping.assembly,
    dfillet=number_slider_3,
    speed=number_slider_2,
    speed_mod=Slider(2, range=0..10),
    init=init,
    set_tasks=set_tasks,
    start=start_3,
    stop_robot=stop_robot,
    stop_server=stop_server,
    send_single_task=send_single_task,
    exit_at_index=exit_at_index,
    exit_index=Slider(1, range=0..10),
    index=idx_2)  # -> out, log, msgs, task, srv; inputs speed_mod: Int32, stop_robot: Boolean, exit_index: Int32, index: Int32
# ---------- fabricate: Python ----------
from scriptcontext import sticky as st
import ur_online_control.ur_direct as urd
from compas_ghpython import update_component
from ur_online_control.ur_direct import URCommandScript
from ur_online_control.communication.tcp_server import TCPFeedbackServer
from ur_online_control.fabrication_process import Fabrication

def get_robot(n):
    if n in [1,2]:
        ur_ip = st["ur_ip"]
        robot = st["robot"]
        return ur_ip, robot
        
def get_radius(i, frames, buffer = 0.7):
    if i == 1 or i == len(frames) - 3 or i == len(frames)-1:
        radius = 0.
    else:
        prev, current, next = frames[i-1].point, frames[i].point, frames[i+1].point
        radius = min((prev - current).length/2 * buffer, (next - current).length/2 * buffer, dfillet)
    return radius

def get_velocity(i, frames):
#    if i == len(frames) - 3 or i == 1:
#        speedval = speed/speed_mod
#    else:
#        speedval = speed
    speedval = speed/1000
    return speedval

def get_move_commands(frames, robot):
    movel_commands = []
    for i, frame_WCS in enumerate(frames):
        frame_RCS = robot.get_frame_in_RCS(frame_WCS)
        radius = get_radius(i, frames)
        velocity = get_velocity(i, frames)
        cmd = list(frame_RCS.point) + list(frame_RCS.axis_angle_vector) + [velocity, radius]
        movel_commands.append(cmd)
    return movel_commands

server_ip = st["server_address"]
server_port = st["server_port"]
ur_port = st["ur_port"]
ur_ip, robot = get_robot(1)

def get_ur_script(key, element, data):
    ur_ip, robot = get_robot(data['robot'])
    move_commands = get_move_commands(element.path, robot)
    tool_angle_axis = list(robot.tool.tcp_frame.point) + list(robot.tool.tcp_frame.axis_angle_vector)
    ur_script = URCommandScript(server_ip=server_ip, server_port=server_port, ur_ip=ur_ip, ur_port=ur_port)
    ur_script.start()
    #ur_script.add_airpick_commands()
    ur_script.set_tcp(tool_angle_axis)
    for i, move_command in enumerate(move_commands):
#        if i == 2:
#            ur_script.airpick_on(max_vac=75, min_vac=25)
#        elif i == 5:
#            ur_script.airpick_off(pressure=55, timeout=5)
#        else:
#            pass
        ur_script.add_move_linear(move_command, feedback="Full")
    ur_script.end(feedback=True)
    ur_script.generate()
    if exit_at_index:
        ur_script.exit_message = move_commands[exit_index][:6]
    return ur_script

def create_tasks():
#    for key, element, data in assembly.elements(data=True):
#        print data
    return [get_ur_script(key,element,data) for key, element, data in assembly.elements(data=True) if key >= index]


class Fabrication_UR(Fabrication):
    def perform_task(self, task):
        self.log("TASK START: ---->>>>>")
        task.generate()
        task.send_script()
        ok = self.server.listen(task.exit_message, 50)
        self.log(task.received_messages)
        if not ok:
            self.log("----<<<<< TASK FAILED")
            return False
        self.log("----<<<<< TASK FINISHED")
        return True

if init:
    fabrication = Fabrication_UR()
    server = TCPFeedbackServer(ip=server_ip, port=server_port)
    server.start()
    fabrication.server = server


if set_tasks:
    tasks = create_tasks()
#    print "tasks", tasks
    fabrication.clear_tasks()
    fabrication.set_tasks(tasks)
#    print fabrication.tasks[0]

if stop_server:
    print("closing server...")
    server.close()
    server.join()
    print("server joined")

if start:
    fabrication.start(server)

if stop_robot:
    urd.stop(ur_ip, ur_port)
    fabrication.is_paused

if send_single_task:
    rt = fabrication.perform_task(fabrication.tasks[index])
    print(rt)
    if rt:
        urd.stop(ur_ip, ur_port)

try:
    srv = server
    fab = fabrication
except NameError:
    srv = None
    fab = None
else:
    if len(fabrication.tasks) > 0:
        msgs = [str(task.exit_message) for task in fabrication.tasks]
        task = fabrication.tasks[0]
    log = fabrication.log_messages
# ---------- end fabricate ----------

panel_2 = Panel(fabricate.srv)
panel_3 = Panel(fabricate.log)
panel_4 = Panel(fabricate.msgs)
panel_5 = Panel(fabricate.task)
panel_6 = Panel(fabricate.out)

# ==== cluster Tools

# ---- group: measurement tool
geo = Geometry(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)
mesh = Mesh(geo)
brep = Brep(geo)
mjoin = MeshJoin(Meshes=mesh)
xaxis_line = Curve(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)
yaxis_line = Curve(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)
tool = PythonScript(meshes=mjoin, breps=brep, xline=xaxis_line, yline=yaxis_line)  # -> tool; inputs meshes: list of Mesh, breps: list of Brep
# ---------- tool: Python ----------
import Rhino.Geometry as rg
from compas.geometry import Frame
from ur_online_control.ur.tool import Tool

xaxis = rg.Line(xline.PointAtStart, xline.PointAtEnd)
yaxis = rg.Line(yline.PointAtStart, yline.PointAtEnd)

if xaxis.From.DistanceTo(yaxis.From) < 0.01:
    origin = xaxis.From
    xaxis = xaxis.Direction
    yaxis = yaxis.Direction
elif xaxis.To.DistanceTo(yaxis.To) < 0.01:
    origin = xaxis.To
    xaxis = -xaxis.Direction
    yaxis = -yaxis.Direction
elif xaxis.From.DistanceTo(yaxis.To) < 0.01:
    origin = xaxis.From
    xaxis = xaxis.Direction
    yaxis = -yaxis.Direction
elif xaxis.To.DistanceTo(yaxis.From) < 0.01:
    origin = xaxis.To
    xaxis = -xaxis.Direction
    yaxis = yaxis.Direction

xaxis.Unitize()
yaxis.Unitize()

print origin
print xaxis
print yaxis

tcp_frame = Frame(origin, xaxis, yaxis)

tool = Tool(tcp_frame)
tool.model = meshes
tool.model_breps = breps
# ---------- end tool ----------

# ---- group: drawing tool
geo_2 = Geometry(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)
mesh_2 = Mesh(geo_2)
brep_2 = Brep(geo_2)
mjoin_2 = MeshJoin(Meshes=mesh_2)
xaxis_line_2 = Curve(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)
yaxis_line_2 = Curve(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)
tool_2 = PythonScript(meshes=mjoin_2, breps=brep_2, xline=xaxis_line_2, yline=yaxis_line_2)  # -> tool; inputs meshes: list of Mesh, breps: list of Brep; same code as tool

# ---- group: air pick 15mm
geo_3 = Geometry(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)
mesh_3 = Mesh(geo_3)
brep_3 = Brep(geo_3)
mjoin_3 = MeshJoin(Meshes=mesh_3)
xaxis_line_3 = Curve(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)
yaxis_line_3 = Curve(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)
tool_3 = PythonScript(meshes=mjoin_3, breps=brep_3, xline=xaxis_line_3, yline=yaxis_line_3)  # -> tool; inputs meshes: list of Mesh, breps: list of Brep; same code as tool

# ---- group: electro magnet
geo_4 = Geometry([<brep referenced from the Rhino model> x6])
mesh_4 = Mesh(geo_4)
brep_4 = Brep(geo_4)
mjoin_4 = MeshJoin(Meshes=mesh_4)
xaxis_line_4 = Curve(<curve referenced from the Rhino model>)
yaxis_line_4 = Curve(<curve referenced from the Rhino model>)
tool_4 = PythonScript(meshes=mjoin_4, breps=brep_4, xline=xaxis_line_4, yline=yaxis_line_4)  # -> tool; inputs meshes: list of Mesh, breps: list of Brep; same code as tool

# ---- group: air pick 40mm
geo_5 = Geometry(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)
mesh_5 = Mesh(geo_5)
brep_5 = Brep(geo_5)
mjoin_5 = MeshJoin(Meshes=mesh_5)
xaxis_line_5 = Curve(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)
yaxis_line_5 = Curve(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)
tool_5 = PythonScript(meshes=mjoin_5, breps=brep_5, xline=xaxis_line_5, yline=yaxis_line_5)  # -> tool; inputs meshes: list of Mesh, breps: list of Brep; same code as tool

# ----
tool_id = ClusterInput()
tool_id_2 = Integer(tool_id)
filter = StreamFilter(Gate=tool_id_2, Stream1=tool, Stream2=tool_5, Stream3=tool_3, Stream4=tool_4, Stream5=tool_2)
py = PythonScript(tool=filter)  # -> tcp_frame, model
# ---------- py: Python ----------
from compas_ghpython import mesh_draw 

if tool:
    tcp_frame = tool.tcp_frame
    model = tool.model
# ---------- end py ----------
tool_6 = Data(filter)
draw = PythonScript(frame=py.tcp_frame)  # -> G, C
# ---------- draw: Python ----------
import Rhino.Geometry as rg
from System.Drawing import Color

if not size:
    size = 0.1

if frame:
    plane = rg.Plane(rg.Point3d(*list(frame.point)), rg.Vector3d(*list(frame.xaxis)), rg.Vector3d(*list(frame.yaxis)))

    G = []
    G.append(rg.Line(plane.Origin, size * plane.XAxis))
    G.append(rg.Line(plane.Origin, size * plane.YAxis))
    G.append(rg.Line(plane.Origin, size * plane.ZAxis))
    
    C = []
    C.append(Color.FromArgb(255, 0, 0))
    C.append(Color.FromArgb(0, 255, 0))
    C.append(Color.FromArgb(0, 0, 255))
# ---------- end draw ----------
tool_7 = ClusterOutput(tool_6)
preview = CustomPreview(Geometry=py.model, Shader=ColourSwatch(SwatchColor=RGBA(141, 170, 178, 150)))
preview_2 = CustomPreview(Geometry=draw.G, Shader=draw.C)

# ==== cluster Robots
model = ClusterInput()

# ---- group: robot geometry
py = PythonScript(model=model)  # -> n
# ---------- py: Python ----------
import time


if model == "UR5":
    n = 0
if model == "UR10":
    n = 1
if model == "UR10e":
    n = 2

print n
# ---------- end py ----------
ur10e_brep = UR10Brep([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])
ur10_brep = UR10Brep([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])
ur5_brep = UR5Brep([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])
filter = StreamFilter(Gate=py, Stream0=ur5_brep, Stream1=ur10_brep, Stream2=ur10e_brep)

# ----
robot_mesh = Mesh(filter)
robot_brep = Brep(filter)
robot_mesh_2 = ClusterOutput(robot_mesh)
robot_brep_2 = ClusterOutput(robot_brep)
