# Grasshopper definition Movement on a curve Online.gh (Grasshopper 1.0.7)

server_port = ValueList({"50002", "50003", "50004", "50005"}, selected="50002")
ur_port = ValueList({"30002"}, selected="30002")

# ---- group: Robot_1
# 1. load robot model
# 2. set tool
# 3. set basis
# Here, you can set the basis for your robot
list = ValueList({"no_tool": 0, "measurement_tool": 1, "air_pick 40mm": 2, "air_pick 15mm": 3, "electromagnet": 4}, selected="air_pick 40mm")
x_axis = Curve(<curve referenced from the Rhino model>)
y_axis = Curve(<curve referenced from the Rhino model>)
list_2 = ValueList({"UR5", "UR10", "UR10e"}, selected="UR5")
tools = Tools(tool_id=list)
plane = PythonScript(plane_axes=[x_axis, y_axis])  # -> plane; inputs plane_axes: list of Curve
# ---------- plane: Python ----------
import Rhino.Geometry as rg

x_axis, y_axis = plane_axes

x_axis = rg.Line(x_axis.PointAtStart, x_axis.PointAtEnd)
y_axis = rg.Line(y_axis.PointAtStart, y_axis.PointAtEnd)

if x_axis.From.DistanceTo(y_axis.From) < 0.01:
    origin = x_axis.From
    xvec = x_axis.Direction
    yvec = y_axis.Direction
elif x_axis.To.DistanceTo(y_axis.To) < 0.01:
    origin = x_axis.To
    xvec = -x_axis.Direction
    yvec = -y_axis.Direction
elif x_axis.From.DistanceTo(y_axis.To) < 0.01:
    origin = x_axis.From
    xvec = x_axis.Direction
    yvec = -y_axis.Direction
elif x_axis.To.DistanceTo(y_axis.From) < 0.01:
    origin = x_axis.To
    xvec = -x_axis.Direction
    yvec = y_axis.Direction

plane = rg.Plane(origin, xvec, yvec)
# ---------- end plane ----------
robot = PythonScript(model=list_2)  # -> robot
# ---------- robot: Python ----------
from ur_online_control.ur.ur10e import UR10e
from ur_online_control.ur.ur10 import UR10
from ur_online_control.ur.ur5 import UR5

from scriptcontext import sticky as st


if model == "UR5":
    robot = UR5()
if model == "UR10":
    robot = UR10()
if model == "UR10e":
    robot = UR10e()
# ---------- end robot ----------
base = PythonScript(base_plane=plane)  # -> base_frame, base_plane
# ---------- base: Python ----------
from compas.geometry import Frame
from compas.geometry import Transformation, Rotation
from compas_ghpython import draw_frame
import math
import Rhino.Geometry as rg


"""
origin = [0,0,0]
xaxis = [1,0,0]
yaxis = [0,1,0]

base_frame = Frame(list(origin), list(xaxis), list(yaxis))
"""

bp = base_plane
base_frame = Frame(bp.Origin, bp.XAxis, bp.YAxis)
# ---------- end base ----------
set_params = PythonScript(robot=robot, tool=tools, base_frame=base.base_frame)  # -> robot
# ---------- set_params: Python ----------
from ur_online_control.ur.ur10e import UR10e
from scriptcontext import sticky as st
from ur_online_control.ur.tool import Tool
from compas.geometry import Frame
print tool,robot, base_frame

if tool:
    robot.set_tool(tool)
else:
    robot.set_tool(Tool(Frame.worldXY()))  
if base_frame:
    robot.set_base(base_frame)

st["robot"] = robot
# ---------- end set_params ----------

# ----
# --> Set your IP address
# --> Set robot IP address
server_ip = ValueList({"192.168.10.44", "192.168.10.12", "192.168.10.11", "192.168.10.10", "192.168.10.3", "192.168.10.2", "192.168.10.1", "127.0.0.1", "192.168.10.111"}, selected="192.168.10.2")
ur_ip = ValueList({"192.168.10.10", "192.168.10.20", "192.168.10.11", "192.168.10.12", "127.0.0.1", "192.168.10.111"}, selected="192.168.10.11")
globals = PythonScript(server_address=server_ip, server_port=server_port, ur_ip=ur_ip, ur_port=ur_port, clear=Button())  # inputs server_port: Int32
# ---------- globals: Python ----------
from scriptcontext import sticky as st

st["server_address"] = server_address
st["server_port"] = server_port

st["ur_ip"] = ur_ip
st["ur_port"] = ur_port

if clear:
    st.clear()
# ---------- end globals ----------

# ----
# Check if UR robot
#  is available
ping = Button()
py = PythonScript(ip=ur_ip, ping=ping)  # -> out, trigger
# ---------- py: Python ----------
from scriptcontext import sticky as st
from ur_online_control.ur_direct import is_available

guid = str(ghenv.Component.InstanceGuid)
txt_key = "txt_" + guid
if txt_key not in st:
    st[txt_key] = ""

if ping:
    
    available = is_available(ip)
    
    if available:
        st[txt_key] = "%s is up!" % ip
        trigger = True
    else:
        st[txt_key] = "%s is down!" % ip
        trigger = False

print(st[txt_key])
# ---------- end py ----------
panel = Panel(py.out)

# ----
# set the curve here
# find out the configurations for the robot to follow the curve
# divide the curve up into points
crv = Curve(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)
idx = Slider(2, range=0..7)
divide = DivideCurve(Curve=crv, Count=10, Kinks=False)  # -> Points, Tangents, Parameters
inverse_multiple = PythonScript(robot=set_params, points=divide.Points, configuration_idx=idx)  # -> configurations; inputs points: list, configuration_idx: Int32, init_configuration: list
# ---------- inverse_multiple: Python ----------
from compas_ghpython import unload_modules
unload_modules('ur_online_control')

import Rhino.Geometry as rg
from compas.geometry import Frame 
from compas.geometry import Transformation
from compas_ghpython import draw_frame
from ur_online_control.ur.kinematics import calculate_configurations_for_path, format_joint_positions


#print init_configuration

# TODO this must be optimized! matrix multiplication!
frames_tool0_RCS = []
for point in points:
    tcp_WCS = Frame(point, [-1,0,0] , [0,1,0])
    tcp_RCS = robot.get_frame_in_RCS(tcp_WCS)
    frames_tool0_RCS.append(robot.get_tool0_frame_from_tcp_frame(tcp_RCS))
    
#configurations = calculate_configurations_for_path(frames_tool0_RCS, robot.params, init_configuration)
configurations = calculate_configurations_for_path(frames_tool0_RCS, robot, init_configuration)
#print configurations
#print configurations
configurations = configurations[min([configuration_idx, len(configurations) - 1])]
print configurations
def format(numbers, k=4):
    #numbers = format_joint_positions(numbers)
    return "[" + ", ".join([("%." + str(k) + "f") % n for n in numbers]) + "]"
# ---------- end inverse_multiple ----------

# ----
# send the movements to the robot
idx_2 = Slider(0, range=0..100)
panel_2 = Panel("move joints")
joint_configurations = Data(inverse_multiple)
list_3 = ValueList({"send all positions": 0, "send only one position": 1}, selected="send all positions")
item = ListItem(List=joint_configurations, Index=idx_2, Wrap=True)
# Same as simple file - constrain joint values in elbow and shoulder
number_slider = Slider(1, range=0..200)
filter = StreamFilter(Gate=list_3, Stream0=joint_configurations, Stream1=item)
movej = PythonScript(joint_configurations=filter, velocity=number_slider)  # -> script, values; inputs joint_configurations: list
# ---------- movej: Python ----------
import ur_online_control.ur_direct as urd
import math 

joint_config = ["movej({}, v={})".format(c.values, velocity) for c in joint_configurations]
#print(joint_config)
commands = urd.URCommandScript()
commands.start()
commands.add_lines(joint_config)
commands.end()

script = commands.generate()
values = joint_configurations[0].values
print([math.degrees(v) for v in values])
print(script)
# ---------- end movej ----------
send = Button()
# talk about local funcs
send_2 = GhPythonScript(script=movej.script, send=send)  # -> out; inputs send: Boolean
# ---------- send_2: Python ----------
from scriptcontext import sticky as st
from ur_online_control.ur_direct import send_script

ur_ip = st["ur_ip"]
ur_port = st["ur_port"]

if send:
    send_script(script, ur_ip, ur_port)
# ---------- end send_2 ----------

idx_3 = Slider(2, range=0..7)

# ----
# draw the robots movement
list_4 = ValueList({"20", "50", "100", "500", "1000", "5000"}, selected="50")
reset = Button()
back = Button()
start = Button()
stop = Button()
step = Button()
full = Button()
robots = Robots(model=list_2)  # -> robot_mesh_2, robot_brep_2
counter = CountThroughList(L=inverse_multiple, start=start, stop=stop, step=step, step_back=back, reset=reset, full=full, interval=list_4)  # -> item, counter; inputs L: list, start: Boolean, stop: Boolean, step_back: Boolean
# ---------- counter: Python ----------
from scriptcontext import sticky as st
from compas_ghpython import update_component


# store data in component
guid = str(ghenv.Component.InstanceGuid)
counter_key = "counter_" + guid
running_key = "running_" + guid

if counter_key not in st:
    st[counter_key] = 0

if running_key not in st:
    st[running_key] = False

if start:
    st[running_key] = True

if stop:
    st[running_key] = False

if step:
    if st[counter_key] < len(L) - 1:
        st[counter_key] += 1

if step_back:
    if st[counter_key] < len(L) - 1:
        st[counter_key] -= 1

if reset:
    st[counter_key] = 0

if full:
    st[counter_key] = len(L)-1

if len(L):
    item = L[st[counter_key]]

if st[running_key]:
    if st[counter_key] < len(L) - 1:
        st[counter_key] += 1
        update_component(ghenv, interval)
    else:
        st[counter_key] = 0
        st[running_key] = False

#st["visualisation_counter"] = st[counter_key]
counter = st[counter_key]
# ---------- end counter ----------
draw = PythonScript(robot=set_params, configuration=counter.item, meshes=robots.robot_mesh_2, breps=robots.robot_brep_2)  # -> out, robot_mesh, tool_mesh, robot_brep, tool_brep, tool0_plane, tcp_plane; inputs meshes: list of Mesh, breps: list of Brep
# ---------- draw: Python ----------
from scriptcontext import sticky as st
from compas_ghpython import draw_frame


if configuration:
    if len(robot.model) == 0:
        robot.model = meshes
        robot.model_breps = breps
        #robot_brep, tool_brep, robot_mesh, tool_mesh = []
    
    tmodel = robot.xdraw(configuration)
    robot_mesh = tmodel[:6]
    tool_mesh = tmodel[6]
    
    if show_brep:
        tmodel = robot.xdraw_brep(configuration)
        robot_brep = tmodel[:6]
        tool_brep = tmodel[6]
        robot_mesh = []
        tool_mesh = []
    
    T0, T1, T2, T3, T4, T5 = robot.get_forward_transformations(configuration)

    tool0_frame, tcp_frame = robot.get_transformed_tool_frames(T5)
    tool0_plane = draw_frame(tool0_frame)
    tcp_plane = draw_frame(tcp_frame)
# ---------- end draw ----------
tool_brep = Brep(draw.tool_brep)
tcp_plane = Plane(draw.tcp_plane)
tool_mesh = Mesh(draw.tool_mesh)
robot_brep = Brep(draw.robot_brep)
tool0_plane = Plane(draw.tool0_plane)
draw_2 = RepresentPlaneAsLines(plane=[tcp_plane, tool0_plane], size=0.1)  # -> G, C
# ---------- draw_2: Python ----------
import Rhino.Geometry as rg
from System.Drawing import Color

if plane:

    G = []
    G.append(rg.Line(plane.Origin, size * plane.XAxis))
    G.append(rg.Line(plane.Origin, size * plane.YAxis))
    G.append(rg.Line(plane.Origin, size * plane.ZAxis))
    
    C = []
    C.append(Color.FromArgb(255, 0, 0))
    C.append(Color.FromArgb(0, 255, 0))
    C.append(Color.FromArgb(0, 0, 255))
# ---------- end draw_2 ----------
robot_mesh = Mesh(draw.robot_mesh)
preview = CustomPreview(Geometry=draw_2.G, Shader=draw_2.C)
preview_2 = CustomPreview(Geometry=[tool_mesh, tool_brep], Shader=ColourSwatch(SwatchColor=RGBA(204, 78, 78, 96)))
preview_3 = CustomPreview(Geometry=[robot_mesh, robot_brep], Shader=ColourSwatch(SwatchColor=RGBA(99, 94, 94, 96)))

# ----
# send commands to robot online
number_slider_2 = Slider(20, range=0..100)
framesfrompoints = GhPythonScript(points=divide.Points)  # -> frames; inputs points: list of Point3d
# ---------- framesfrompoints: Python ----------
from compas.geometry import Frame 

frames = []
for point in points:
    frames.append(Frame(point, [-1,0,0] , [0,1,0]))
# ---------- end framesfrompoints ----------
send_single_task = Button()
exit_at_index = BooleanToggle(False)
stop_server = Button()
stop_robot = Button()
set_tasks = Button()
start_2 = Button()
init = Button()
fabricate = GhPythonScript(
    frames=framesfrompoints,
    dfillet=number_slider_2,
    speed=Slider(50, range=0..300),
    speed_mod=Slider(2, range=0..10),
    init=init,
    set_tasks=set_tasks,
    start=start_2,
    stop_robot=stop_robot,
    stop_server=stop_server,
    send_single_task=send_single_task,
    exit_at_index=exit_at_index,
    exit_index=Slider(1, range=0..10))  # -> out, log, msgs, task, srv; inputs frames: list, speed_mod: Int32, stop_robot: Boolean, exit_index: Int32, index: Int32
# ---------- fabricate: Python ----------
from scriptcontext import sticky as st
import ur_online_control.ur_direct as urd
from compas_ghpython import update_component

from ur_online_control.ur_direct import URCommandScript
from ur_online_control.communication.tcp_server import TCPFeedbackServer
from ur_online_control.fabrication_process import Fabrication

def get_robot(n):
    if n in [1,2]:
        ur_ip = st["ur_ip"]
        robot = st["robot"]
        return ur_ip, robot
        
def get_radius(i, frames, buffer = 0.7):
    if i == 1 or i == len(frames) - 3 or i == len(frames)-1:
        radius = 0.
    else:
        prev, current, next = frames[i-1].point, frames[i].point, frames[i+1].point
        radius = min((prev - current).length/2 * buffer, (next - current).length/2 * buffer, dfillet)
    return radius

def get_velocity():
    speedval = speed/1000
    return speedval

def get_move_commands(frames, robot):
    movel_commands = []

    for i, frame_WCS in enumerate(frames):
        frame_RCS = robot.get_frame_in_RCS(frame_WCS)
        radius = get_radius(i, frames)
        velocity = get_velocity()
        cmd = list(frame_RCS.point) + list(frame_RCS.axis_angle_vector) + [velocity, radius]
        movel_commands.append(cmd)
    return movel_commands


def get_ur_script(frames):
    ur_ip, robot = get_robot(1)
    move_commands = get_move_commands(frames, robot)
    tool_angle_axis = list(robot.tool.tcp_frame.point) + list(robot.tool.tcp_frame.axis_angle_vector)
    ur_script = URCommandScript(server_ip=server_ip, server_port=server_port, ur_ip=ur_ip, ur_port=ur_port)
    ur_script.start()
    ur_script.set_tcp(tool_angle_axis)
    for i, move_command in enumerate(move_commands):
        ur_script.add_move_linear(move_command, feedback="Full")
    ur_script.end(feedback=True)
    ur_script.generate()
    if exit_at_index:
        ur_script.exit_message = move_commands[exit_index][:6]
    return ur_script

def create_tasks():
    return get_ur_script(frames)


class Fabrication_UR(Fabrication):
    def perform_task(self, task):
        self.log("TASK START: ---->>>>>")
        task.generate()
        task.send_script()
        ok = self.server.listen(task.exit_message, 50)
        self.log(task.received_messages)
        if not ok:
            self.log("----<<<<< TASK FAILED")
            return False
        self.log("----<<<<< TASK FINISHED")
        return True



server_ip = st["server_address"]
server_port = st["server_port"]
ur_port = st["ur_port"]
ur_ip, robot = get_robot(1)




if init:
    fabrication = Fabrication_UR()
    server = TCPFeedbackServer(ip=server_ip, port=server_port)
    server.start()
    fabrication.server = server


if set_tasks:
    tasks = create_tasks()
    fabrication.clear_tasks()
    fabrication.set_tasks(tasks)

if stop_server:
    print("closing server...")
    server.close()
    server.join()
    print("server joined")

if start:
    fabrication.start(server)

if stop_robot:
    urd.stop(ur_ip, ur_port)
    fabrication.is_paused

if send_single_task:
    rt = fabrication.perform_task(fabrication.tasks[index])
    print(rt)
    if rt:
        urd.stop(ur_ip, ur_port)

try:
    srv = server
    fab = fabrication
except NameError:
    srv = None
    fab = None
    
else:
    if len(fabrication.tasks) > 0:
        msgs = [str(task.exit_message) for task in fabrication.tasks]
        task = fabrication.tasks[0]
    log = fabrication.log_messages
# ---------- end fabricate ----------
panel_3 = Panel(fabricate.srv)
panel_4 = Panel(fabricate.log)
panel_5 = Panel(fabricate.msgs)
panel_6 = Panel(fabricate.task)
panel_7 = Panel(fabricate.out)

# ==== cluster Tools

# ---- group: measurement tool
geo = Geometry(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)
mesh = Mesh(geo)
brep = Brep(geo)
mjoin = MeshJoin(Meshes=mesh)
xaxis_line = Curve(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)
yaxis_line = Curve(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)
tool = PythonScript(meshes=mjoin, breps=brep, xline=xaxis_line, yline=yaxis_line)  # -> tool; inputs meshes: list of Mesh, breps: list of Brep
# ---------- tool: Python ----------
import Rhino.Geometry as rg
from compas.geometry import Frame
from ur_online_control.ur.tool import Tool

xaxis = rg.Line(xline.PointAtStart, xline.PointAtEnd)
yaxis = rg.Line(yline.PointAtStart, yline.PointAtEnd)

if xaxis.From.DistanceTo(yaxis.From) < 0.01:
    origin = xaxis.From
    xaxis = xaxis.Direction
    yaxis = yaxis.Direction
elif xaxis.To.DistanceTo(yaxis.To) < 0.01:
    origin = xaxis.To
    xaxis = -xaxis.Direction
    yaxis = -yaxis.Direction
elif xaxis.From.DistanceTo(yaxis.To) < 0.01:
    origin = xaxis.From
    xaxis = xaxis.Direction
    yaxis = -yaxis.Direction
elif xaxis.To.DistanceTo(yaxis.From) < 0.01:
    origin = xaxis.To
    xaxis = -xaxis.Direction
    yaxis = yaxis.Direction

xaxis.Unitize()
yaxis.Unitize()

print origin
print xaxis
print yaxis

tcp_frame = Frame(origin, xaxis, yaxis)

tool = Tool(tcp_frame)
tool.model = meshes
tool.model_breps = breps
# ---------- end tool ----------

# ---- group: air pick 15mm
geo_2 = Geometry(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)
mesh_2 = Mesh(geo_2)
brep_2 = Brep(geo_2)
mjoin_2 = MeshJoin(Meshes=mesh_2)
xaxis_line_2 = Curve(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)
yaxis_line_2 = Curve(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)
tool_2 = PythonScript(meshes=mjoin_2, breps=brep_2, xline=xaxis_line_2, yline=yaxis_line_2)  # -> tool; inputs meshes: list of Mesh, breps: list of Brep; same code as tool

# ---- group: electro magnet
geo_3 = Geometry([<brep referenced from the Rhino model> x6])
mesh_3 = Mesh(geo_3)
brep_3 = Brep(geo_3)
mjoin_3 = MeshJoin(Meshes=mesh_3)
xaxis_line_3 = Curve(<curve referenced from the Rhino model>)
yaxis_line_3 = Curve(<curve referenced from the Rhino model>)
tool_3 = PythonScript(meshes=mjoin_3, breps=brep_3, xline=xaxis_line_3, yline=yaxis_line_3)  # -> tool; inputs meshes: list of Mesh, breps: list of Brep; same code as tool

# ---- group: air pick 40mm
geo_4 = Geometry(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)
mesh_4 = Mesh(geo_4)
brep_4 = Brep(geo_4)
mjoin_4 = MeshJoin(Meshes=mesh_4)
xaxis_line_4 = Curve(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)
yaxis_line_4 = Curve(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)
tool_4 = PythonScript(meshes=mjoin_4, breps=brep_4, xline=xaxis_line_4, yline=yaxis_line_4)  # -> tool; inputs meshes: list of Mesh, breps: list of Brep; same code as tool

# ----
tool_id = ClusterInput()
tool_id_2 = Integer(tool_id)
filter = StreamFilter(Gate=tool_id_2, Stream1=tool, Stream2=tool_4, Stream3=tool_2, Stream4=tool_3)
py = PythonScript(tool=filter)  # -> tcp_frame, model
# ---------- py: Python ----------
from compas_ghpython import mesh_draw 

if tool:
    tcp_frame = tool.tcp_frame
    model = tool.model
# ---------- end py ----------
tool_5 = Data(filter)
draw = PythonScript(frame=py.tcp_frame)  # -> G, C
# ---------- draw: Python ----------
import Rhino.Geometry as rg
from System.Drawing import Color

if not size:
    size = 0.1

if frame:
    plane = rg.Plane(rg.Point3d(*list(frame.point)), rg.Vector3d(*list(frame.xaxis)), rg.Vector3d(*list(frame.yaxis)))

    G = []
    G.append(rg.Line(plane.Origin, size * plane.XAxis))
    G.append(rg.Line(plane.Origin, size * plane.YAxis))
    G.append(rg.Line(plane.Origin, size * plane.ZAxis))
    
    C = []
    C.append(Color.FromArgb(255, 0, 0))
    C.append(Color.FromArgb(0, 255, 0))
    C.append(Color.FromArgb(0, 0, 255))
# ---------- end draw ----------
tool_6 = ClusterOutput(tool_5)
preview = CustomPreview(Geometry=py.model, Shader=ColourSwatch(SwatchColor=RGBA(141, 170, 178, 150)))
preview_2 = CustomPreview(Geometry=draw.G, Shader=draw.C)

# ==== cluster Robots
model = ClusterInput()

# ---- group: robot geometry
py = PythonScript(model=model)  # -> n
# ---------- py: Python ----------
import time


if model == "UR5":
    n = 0
if model == "UR10":
    n = 1
if model == "UR10e":
    n = 2

print n
# ---------- end py ----------
ur10e_brep = UR10Brep([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])
ur10_brep = UR10Brep([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])
ur5_brep = UR5Brep([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])
filter = StreamFilter(Gate=py, Stream0=ur5_brep, Stream1=ur10_brep, Stream2=ur10e_brep)

# ----
robot_brep = Brep(filter)
robot_mesh = Mesh(filter)
robot_mesh_2 = ClusterOutput(robot_mesh)
robot_brep_2 = ClusterOutput(robot_brep)
