# Grasshopper definition robots.gh (Grasshopper 1.0.7)

robots = Robots()  # -> robot_mesh_2, robot_brep_2

# ==== cluster Robots
model = ClusterInput()
ur3_brep = Brep(reverse([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]))

# ---- group: robot geometry
py = PythonScript(model=model)  # -> n
# ---------- py: Python ----------
import time

if model == "UR3":
    n = 0

if model == "UR5":
    n = 1

if model == "UR10":
    n = 2

if model == "UR10e":
    n = 3

print n
# ---------- end py ----------
ur10e_brep = UR10Brep([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])
ur10_brep = UR10Brep([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])
ur5_brep = UR5Brep([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])
filter = StreamFilter(Gate=py, Stream0=ur3_brep, Stream1=ur5_brep, Stream2=ur10_brep, Stream3=ur10e_brep)

# ----
robot_mesh = Mesh(filter)
robot_brep = Brep(filter)
robot_mesh_2 = ClusterOutput(robot_mesh)
robot_brep_2 = ClusterOutput(robot_brep)
